# Grasshopper definition AIStructureGenerator.gh (Grasshopper 1.0.7)
# plug-ins: Kangaroo2 Components

list = ValueList({"DragonflyWings", "DamselflyWings", "GrasshopperWings", "AmazonWaterLily", "AutoMode"}, selected="DragonflyWings")
form_boundary = Curve(<curve referenced from the Rhino model>)
crv = Curve([<curve referenced from the Rhino model> x296])  # disabled
slider = Slider(0.001, range=0..0.001)  # disabled
explode = Explode(Curve=crv, Recursive=True)  # -> flatten(Segments), Vertices; disabled
select_mode = Select_mode(G=form_boundary, mode=list)
splitcurves = PythonScript(curves=explode.Segments, tolerance=slider)  # -> out, pieces; inputs curves: list of Curve; disabled
# ---------- splitcurves: Python ----------
import Rhino
import clr
clr.AddReference("Grasshopper")
from Grasshopper.Kernel.Data import GH_Path
from Grasshopper import DataTree
import ghpythonlib.components as gh
import rhinoscriptsyntax as rs


def boxes_overlap(boxA, boxB):
    """Check if there is any overlap between two bounding boxes.
    """
    intersection = boxA.Intersection(boxA, boxB)
    if intersection.IsValid:
        intSize = intersection.Diagonal.Length
        return intSize > 0.0
    else:
        return False

def distribute_intersections(curveIntersections):
    """returns two lists: the parameters on curveA, and the parameters on
    curveB.
    """
    params_a = []
    params_b = []
    for intersection in curveIntersections:
        if not intersection.IsOverlap:
            params_a.append(intersection.ParameterA)
            params_b.append(intersection.ParameterB)
        else: # it's an overlap!
            intervalA = intersection.OverlapA
            intervalB = intersection.OverlapB
            params_a.extend([intervalA.T0, intervalA.T1])
            params_b.extend([intervalB.T0, intervalB.T1])
    return params_a, params_b

def split(curves, tol=0.001):
    """Take a set of curves and split them at every point-type intersection.
    """
    results = []
    parameter_bank = {}
    indices = range(len(curves) - 1, -1, -1)
    for i in indices:
        parameter_bank[i] = []
    for i in indices:
        # check to see if this curve has any previously found intersections
        intersection_parameters = parameter_bank[i]
        if curves:
            curve = curves.pop()
            # check for self intersections first
            self_intersections = Rhino.Geometry.Intersect.Intersection.CurveSelf(curve, tol)
            if self_intersections.Count > 0:
                this_intersect, that_intersect = distribute_intersections(self_intersections)
                intersection_parameters.extend(this_intersect)
                intersection_parameters.extend(that_intersect)
            # check if there are any other curves
            if curves:
                # get the bounding box for this curve
                thisbbox = curve.GetBoundingBox(False)
                # go through the other curves
                for j, other in enumerate(curves):
                    # check if the other curve is anywhere near this one
                    otherbbox = other.GetBoundingBox(False)
                    if boxes_overlap(thisbbox, otherbbox):
                        # get the intersections with the other curve
                        other_intersections = Rhino.Geometry.Intersect.Intersection.CurveCurve( curve,
                                other, tol, tol)
                        if other_intersections.Count > 0:
                            this_intersect, that_intersect = distribute_intersections(other_intersections)
                            intersection_parameters.extend(this_intersect)
                            parameter_bank[j].extend(that_intersect)
        if intersection_parameters:
            # chop up the curve
            curve_pieces = curve.Split(intersection_parameters)
            for curvesss in curve_pieces:
                results.append(rs.AddLine(curvesss.PointAtStart,curvesss.PointAtEnd))
        else:
            results.append(curve)
    return results

if curves:
    if tolerance == None:
        tolerance = 0.001
    pieces = split(curves, tolerance)
# ---------- end splitcurves ----------
len = Length(Curve=splitcurves.pieces)  # disabled
generate_input_image = Generate_Input_Image(txt=select_mode, crv=form_boundary, run=Toggle(False))  # -> file_path, pt_7, pt_5, pt_6
larger = LargerThan(FirstNumber=len, SecondNumber=0.01)  # -> LargerThan, OrEqualTo; disabled
cull = CullPattern(List=splitcurves.pieces, CullPattern=larger.LargerThan)  # disabled
generate_force_image = GhPythonScript(type=select_mode, file_path=generate_input_image.file_path, run=Toggle(False))  # -> out, file_path; inputs run: Boolean
# ---------- generate_force_image: Python ----------
__author__ = "Platina"
__version__ = "2021.07.19"

#encoding=utf-8
import os
import shutil
import rhinoscriptsyntax as rs
from subprocess import Popen, PIPE
DETACHED_PROCESS = 0x00000008

import ghpythonlib.components as gh

if run:
    
    if type=="DragonflyWings":
        os.system("cd C:\\AIStructureGenerator && C: && python test.py --name fmb_to_fcb --dataroot ./datasets/fmb_to_fcb/ --no_instance --label_nc 0 --loadSize 1000 --fineSize 1000 --resize_or_crop none --how_many 1 --gpu_ids 0")
        shutil.copy(r'C:\\AIStructureGenerator\\results\\fmb_to_fcb\\test_latest\\images\\test_synthesized_image.jpg', r'C:\\AIStructureGenerator\\datasets\\fcb_to_fc\\test_A\\test.jpg')
        shutil.copy(r'C:\\AIStructureGenerator\\results\\fmb_to_fcb\\test_latest\\images\\test_synthesized_image.jpg', r'C:\\AIStructureGenerator\\results\\result_bou.jpg')
        os.system("cd C:\\AIStructureGenerator && C: && python test.py --name fcb_to_fc --dataroot ./datasets/fcb_to_fc/ --no_instance --label_nc 0 --loadSize 1000 --fineSize 1000 --resize_or_crop none --how_many 1 --gpu_ids 0")
        shutil.copy(r'C:\\AIStructureGenerator\\results\\fcb_to_fc\\test_latest\\images\\test_synthesized_image.jpg', r'C:\\AIStructureGenerator\\datasets\\fc_to_fcg\\test_A\\test.jpg')
        os.system("cd C:\\AIStructureGenerator && C: && python test.py --name fc_to_fcg --dataroot ./datasets/fc_to_fcg/ --no_instance --label_nc 0 --loadSize 1000 --fineSize 1000 --resize_or_crop none --how_many 1 --gpu_ids 0")
        shutil.copy(r'C:\\AIStructureGenerator\\results\\fc_to_fcg\\test_latest\\images\\test_synthesized_image.jpg', r'C:\\AIStructureGenerator\\results\\result.jpg')
    elif type=="DamselflyWings":
        os.system("cd C:\\AIStructureGenerator && C: && python test.py --name Damselfly_1 --dataroot ./datasets/Damselfly_1/ --no_instance --label_nc 0 --loadSize 1000 --fineSize 1000 --resize_or_crop none --how_many 1 --gpu_ids 0")
        shutil.copy(r'C:\\AIStructureGenerator\\results\\Damselfly_1\\test_latest\\images\\test_synthesized_image.jpg', r'C:\\AIStructureGenerator\\datasets\\Damselfly_2\\test_A\\test.jpg')
        shutil.copy(r'C:\\AIStructureGenerator\\results\\Damselfly_1\\test_latest\\images\\test_synthesized_image.jpg', r'C:\\AIStructureGenerator\\results\\result_bou.jpg')
        os.system("cd C:\\AIStructureGenerator && C: && python test.py --name Damselfly_2 --dataroot ./datasets/Damselfly_2/ --no_instance --label_nc 0 --loadSize 1000 --fineSize 1000 --resize_or_crop none --how_many 1 --gpu_ids 0")
        shutil.copy(r'C:\\AIStructureGenerator\\results\\Damselfly_2\\test_latest\\images\\test_synthesized_image.jpg', r'C:\\AIStructureGenerator\\results\\result.jpg')
    elif type=="GrasshopperWings":
        os.system("cd C:\\AIStructureGenerator && C: && python test.py --name GH_1 --dataroot ./datasets/GH_1/ --no_instance --label_nc 0 --loadSize 1000 --fineSize 1000 --resize_or_crop none --how_many 1 --gpu_ids 0")
        shutil.copy(r'C:\\AIStructureGenerator\\results\\GH_1\\test_latest\\images\\test_synthesized_image.jpg', r'C:\\AIStructureGenerator\\datasets\\GH_2\\test_A\\test.jpg')
        shutil.copy(r'C:\\AIStructureGenerator\\results\\GH_1\\test_latest\\images\\test_synthesized_image.jpg', r'C:\\AIStructureGenerator\\results\\result_bou.jpg')
        os.system("cd C:\\AIStructureGenerator && C: && python test.py --name GH_2 --dataroot ./datasets/GH_2/ --no_instance --label_nc 0 --loadSize 1000 --fineSize 1000 --resize_or_crop none --how_many 1 --gpu_ids 0")
        shutil.copy(r'C:\\AIStructureGenerator\\results\\GH_2\\test_latest\\images\\test_synthesized_image.jpg', r'C:\\AIStructureGenerator\\results\\result.jpg')
    elif type=="AmazonWaterLily":
        os.system("cd C:\\AIStructureGenerator && C: && python test.py --name AWL_1 --dataroot ./datasets/AWL_1/ --no_instance --label_nc 0 --loadSize 1000 --fineSize 1000 --resize_or_crop none --how_many 1 --gpu_ids 0")
        shutil.copy(r'C:\\AIStructureGenerator\\results\\AWL_1\\test_latest\\images\\test_synthesized_image.jpg', r'C:\\AIStructureGenerator\\datasets\\AWL_2\\test_A\\test.jpg')
        shutil.copy(r'C:\\AIStructureGenerator\\results\\AWL_1\\test_latest\\images\\test_synthesized_image.jpg', r'C:\\AIStructureGenerator\\results\\result_bou.jpg')
        os.system("cd C:\\AIStructureGenerator && C: && python test.py --name AWL_2 --dataroot ./datasets/AWL_2/ --no_instance --label_nc 0 --loadSize 1000 --fineSize 1000 --resize_or_crop none --how_many 1 --gpu_ids 0")
        shutil.copy(r'C:\\AIStructureGenerator\\results\\AWL_2\\test_latest\\images\\test_synthesized_image.jpg', r'C:\\AIStructureGenerator\\results\\result.jpg')
        
    file_path = 'C:\\AIStructureGenerator\\results\\result.jpg'
# ---------- end generate_force_image ----------
dupln = RemoveDuplicateLines(Lines=cull, Tolerance=0.01)  # disabled
place_force_image = GhPythonScript(
    pt1=generate_input_image.pt_7,
    pt2=generate_input_image.pt_5,
    pt3=generate_input_image.pt_6,
    file_path=generate_force_image.file_path,
    run=Toggle(False))  # inputs pt1: Point3d, pt2: Point3d, pt3: Point3d, run: Boolean
# ---------- place_force_image: Python ----------
__author__ = "Platina"
__version__ = "2021.07.19"

import rhinoscriptsyntax as rs

if run:
    
    cmd = "_-Pictureframe " + file_path + " " + "3Point" + " " + str(pt1) + " " + str(pt2) + " " + str(pt3) + " " + " _EnterEnd"
    
    rs.Command(cmd, True)
# ---------- end place_force_image ----------
crv_2 = Curve(dupln)  # disabled
generate_force_geometry = Generate_Force_Geometry(
    pt=generate_input_image.pt_7,
    pt_3=generate_input_image.pt_5,
    pt_2=generate_input_image.pt_6,
    txt=generate_force_image.file_path,
    bool=Toggle(False))  # -> L, G_2, G
grid_divisions = Integer(20)  # disabled
crv_3 = Curve(simplify(crv_2))  # disabled
x_bounds = Domain(Domain(1950, 3650))  # disabled
y_bounds = Domain(Domain(2750, 3550))  # disabled
dom² = Domain²(DomainU=x_bounds, DomainV=y_bounds)  # disabled
# modify the force diagram manually if needed and then assign the closed polygons here.
crv_4 = Curve(generate_force_geometry.G_2)
hem_open_xy_networks = VBScript(seg=crv_3, bnd=dom², sbdv=grid_divisions)  # -> out, flatten(e), flatten(eOV), flatten(ePE), flatten(eNE), flatten(eTE), flatten(eIF), flatten(v)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; inputs seg: list of Curve; disabled; same code as hem_open_xy_networks
force_geometry = Curve([<curve referenced from the Rhino model> x1272])
pline = PolyLine(Vertices=hem_open_xy_networks.f, Closed=True)  # disabled
generate_dual = Generate_Dual(crv=force_geometry, bool=Toggle(False))
flatten = FlattenTree(Tree=pline, Path="{0}")  # disabled
srf = Surface(flatten)  # disabled
area = Area(Geometry=srf)  # -> Area, Centroid; disabled
generate_ann_input = Generate_ANN_Input(crv=generate_dual, bool=Toggle(False))
sort = SortList(Keys=area.Area, ValuesA=flatten)  # -> Keys, ValuesA; disabled
shift = ShiftList(List=sort.ValuesA, Shift=-1, Wrap=False)  # disabled
srf_2 = Surface(shift)  # disabled
explode_2 = Explode(Curve=shift, Recursive=True)  # -> Segments, simplify(Vertices); disabled
generate_form_length = GhPythonScript(type=select_mode, file_path=generate_ann_input, run=Toggle(False))  # -> out, file_path; inputs run: Boolean
# ---------- generate_form_length: Python ----------
__author__ = "Platina"
__version__ = "2021.07.19"

#encoding=utf-8
import os
import rhinoscriptsyntax as rs
DETACHED_PROCESS = 0x00000010

if run:
    
    os.system("cd C:\\AIStructureGenerator\\ANN && C: && python main.py "+type)
    
    file_path = "C:\\AIStructureGenerator\\ANN\\results.csv"
# ---------- end generate_form_length ----------
shift_2 = ShiftList(List=explode_2.Vertices, Shift=1, Wrap=False)  # -> simplify(List); disabled
path_mapper = PathMapper(shift_2, source="{a}", target="{0;a}")  # disabled
generate_optimization_training_data__opt = Generate_Optimization_Training_Data_Optional(
    crv_2=form_boundary,
    crv=generate_dual,
    txt=generate_form_length.file_path,
    int=Slider(300, range=0..1000),
    pleaserun=Toggle(False))  # "Generate_Optimization_Training_Data_(optional)"
pt = Point(path_mapper)  # disabled

# ---- group: 角度15，迭代更新凹多边形顶点
python = GhPythonScript(pts=pt)  # -> out, a, count, loops; inputs pts: tree of Point3d; disabled
# ---------- python: Python ----------
__author__ = "Platina"
__version__ = "2019.11.23"

import rhinoscriptsyntax as rs
import ghpythonlib.components as gh
import ghpythonlib.treehelpers as ghtree
import math

pts = ghtree.tree_to_list(pts)

loops = 0
while True:
    count = 0
    for i in range(len(pts)):
        j = 0
        while j<len(pts[i]):
            q = j - 1
            p = j + 1
            if q<0:
                q = len(pts[i])-1
            if p>len(pts[i])-1:
                p = 0
            pt1 = pts[i][q]
            pt2 = gh.ConstructPoint(pts[i][j][0],pts[i][j][1],pts[i][j][2])
            pt3 = pts[i][p]
            vec1 = gh.UnitVector(pt2 - pt1)
            vec2 = gh.UnitVector(pt3 - pt2)
            if (gh.VectorLength(vec1)!=0) and (gh.VectorLength(vec2)!=0):
                ang = rs.VectorAngle(vec1,vec2)
                cro = rs.VectorCrossProduct(vec1,vec2)
                if (ang<15) or (cro[2]>0):
                    count = count + 1
                    vec3 = gh.UnitVector(pt1 - pt2)
                    vec = gh.UnitVector(vec3+vec2)
                    if (cro[2]<0):
                        vec = gh.Reverse(vec)
                    elif (cro[2]==0):
                        vec = gh.Rotate(vec1,math.pi/2,gh.XYPlane())
                    vec = gh.UnitVector(vec) * 1.111111
                    for ii in range(len(pts)):
                        for jj in range(len(pts[ii])):
                            if rs.Distance(pts[ii][jj],pt2)<0.01:
                                pts[ii][jj] = pt2 + vec
            j = j + 1
    if count==0:
        break
    if loops>=50:
        break
    loops = loops + 1

a = ghtree.list_to_tree(pts)
# ---------- end python ----------

# ---- group: 迭代更新凹多边形顶点
python_2 = GhPythonScript(pts=pt)  # -> out, a, count, loops; inputs pts: tree of Point3d; disabled
# ---------- python_2: Python ----------
__author__ = "Platina"
__version__ = "2019.11.23"

import rhinoscriptsyntax as rs
import ghpythonlib.components as gh
import ghpythonlib.treehelpers as ghtree
import math

pts = ghtree.tree_to_list(pts)

loops = 0
while True:
    count = 0
    for i in range(len(pts)):
        j = 0
        while j<len(pts[i]):
            q = j - 1
            p = j + 1
            if q<0:
                q = len(pts[i])-1
            if p>len(pts[i])-1:
                p = 0
            pt1 = pts[i][q]
            pt2 = gh.ConstructPoint(pts[i][j][0],pts[i][j][1],pts[i][j][2])
            pt3 = pts[i][p]
            vec1 = gh.UnitVector(pt2 - pt1)
            vec2 = gh.UnitVector(pt3 - pt2)
            if (gh.VectorLength(vec1)!=0) and (gh.VectorLength(vec2)!=0):
                ang = rs.VectorAngle(vec1,vec2)
                cro = rs.VectorCrossProduct(vec1,vec2)
                if (ang<3) or (cro[2]>0):
                    count = count + 1
                    vec3 = gh.UnitVector(pt1 - pt2)
                    vec = gh.UnitVector(vec3+vec2)
                    if (cro[2]<0):
                        vec = gh.Reverse(vec)
                    elif (cro[2]==0):
                        vec = gh.Rotate(vec1,math.pi/2,gh.XYPlane())
                    vec = gh.UnitVector(vec) * 1.111111
                    for ii in range(len(pts)):
                        for jj in range(len(pts[ii])):
                            if rs.Distance(pts[ii][jj],pt2)<0.01:
                                pts[ii][jj] = pt2 + vec
            j = j + 1
    if count==0:
        break
    if loops>=50:
        break
    loops = loops + 1

a = ghtree.list_to_tree(pts)
# ---------- end python_2 ----------

# ----
pline_2 = PolyLine(Vertices=python_2.a, Closed=True)  # -> flatten(Polyline); disabled
pline_3 = PolyLine(Vertices=python.a, Closed=True)  # -> flatten(Polyline); disabled
train_optimization_model__optional = GhPythonScript(file_path=generate_optimization_training_data__opt, run=Toggle(False))  # -> out, file_path; inputs run: Boolean
# ---------- train_optimization_model__optional: Python ----------
__author__ = "Platina"
__version__ = "2021.07.19"

#encoding=utf-8
import os
import rhinoscriptsyntax as rs
DETACHED_PROCESS = 0x00000010

if run:
    
    os.system("cd C:\\AIStructureGenerator\\ANN2 && C: && python train.py ")
    
    file_path = "C:\\AIStructureGenerator\\ANN2\\model\\model999.ckpt"
# ---------- end train_optimization_model__optional ----------
crv_5 = Curve(pline_3)  # disabled
srf_3 = Surface(pline_2)  # disabled
faceconvex = FaceConvex(srf=srf_3)  # -> srf_3, C; disabled
find_optimization_sa = GhPythonScript(file_path=train_optimization_model__optional.file_path, run=Toggle(False))  # -> out, file_path; inputs run: Boolean
# ---------- find_optimization_sa: Python ----------
__author__ = "Platina"
__version__ = "2021.07.19"

#encoding=utf-8
import os
import rhinoscriptsyntax as rs
DETACHED_PROCESS = 0x00000010

if run:
    
    os.system("cd C:\\AIStructureGenerator\\ANN2 && C: && python SA.py ")
    
    file_path = "C:\\AIStructureGenerator\\ANN2\\results.csv"
else:
    file_path = ""
# ---------- end find_optimization_sa ----------
argb = SplitARGB(Colour=faceconvex.C)  # -> Alpha, Red, Green, Blue; disabled
smaller = SmallerThan(FirstNumber=argb.Red, SecondNumber=0.3)  # -> SmallerThan, OrEqualTo; disabled
generate_structural_form = Generate_Structural_Form(
    crv=form_boundary,
    crv_3=generate_dual,
    F=generate_form_length.file_path,
    num_3=Slider(0.3, range=0..1),
    F_2=find_optimization_sa.file_path,
    pleaserun=Toggle(False))
cull_2 = CullPattern(List=faceconvex.srf_3, CullPattern=smaller.SmallerThan)  # disabled

crv_6 = Curve([<curve referenced from the Rhino model> x763])  # disabled
crv_7 = Curve(pline_2)  # disabled

srf_4 = Surface(crv_6)  # disabled
extr = Extrude(Base=srf_4, Direction=Vector(0, 0, -100))  # disabled
srf_5 = Surface(crv_7)  # disabled
faceconvex_2 = FaceConvex(srf=srf_4)  # -> srf_3, C; disabled
argb_2 = SplitARGB(Colour=faceconvex_2.C)  # -> Alpha, Red, Green, Blue; disabled
extr_2 = Extrude(Base=srf_5, Direction=Vector(0, 0, -100))  # disabled
smaller_2 = SmallerThan(FirstNumber=argb_2.Red, SecondNumber=0.3)  # -> SmallerThan, OrEqualTo; disabled
cull_3 = CullPattern(List=faceconvex_2.srf_3, CullPattern=smaller_2.SmallerThan)  # disabled

# ==== cluster Generate_Input_Image
crv = ClusterInput()
run = ClusterInput()
txt = ClusterInput()
crv_2 = Curve(crv)
python = GhPythonScript(run=run)  # -> out, a, b; inputs run: Boolean
# ---------- python: Python ----------
__author__ = "Platina"
__version__ = "2021.07.19"

import rhinoscriptsyntax as rs

if run:
    a = 1024
    b = 512
else:
    a = 0
    b = 0
# ---------- end python ----------
txt_2 = Text(txt)
brec = BoundingRectangle(Geometry=crv_2, Plane=PlaneXY(0, 0, 0), Axis=0, Slide=0, Union=True)  # -> Bounding, DimensionX, DimensionY
drec = DeconstuctRectangle(Rectangle=brec.Bounding)  # -> BasePlane, XInterval, YInterval
dedomain = DeconstructDomain(Domain=drec.YInterval)  # -> Start, End
dedomain_2 = DeconstructDomain(Domain=drec.XInterval)  # -> Start, End
subtraction = Subtraction(A=dedomain.End, B=dedomain.Start)
subtraction_2 = Subtraction(A=dedomain_2.End, B=dedomain_2.Start)
python_2 = GhPythonScript(x=subtraction_2, y=subtraction, z=Slider(2, range=0..10))  # -> out, a, b
# ---------- python_2: Python ----------
__author__ = "Platina"
__version__ = "2021.07.19"

import rhinoscriptsyntax as rs

if x>2*y:
    a = x
    b = x/2
else:
    a = 2*y
    b = y

a = a/2*z
b = b/2*z
# ---------- end python_2 ----------
pt = Point(drec.BasePlane)
pdecon = Deconstruct(Point=pt)  # -> XComponent, YComponent, ZComponent
subtraction_3 = Subtraction(A=pdecon.XComponent, B=python_2.a)
subtraction_4 = Subtraction(A=pdecon.YComponent, B=python_2.b)
addition = Addition(A=pdecon.YComponent, B=python_2.b)
addition_2 = Addition(A=pdecon.XComponent, B=python_2.a)
pt_2 = ConstructPoint(XCoordinate=subtraction_3, YCoordinate=subtraction_4, ZCoordinate=0)
pt_3 = ConstructPoint(XCoordinate=addition_2, YCoordinate=addition, ZCoordinate=0)
multiplication = Multiplication(A=python_2.a, B=2)
multiplication_2 = Multiplication(A=python_2.b, B=2)
xz = XZPlane(Origin=drec.BasePlane)
division = Division(A=multiplication, B=1024)
division_2 = Division(A=multiplication_2, B=512)
dom = ConstructDomain(DomainStart=0, DomainEnd=division_2)
dom_2 = ConstructDomain(DomainStart=0, DomainEnd=division)
rectangle = Rectangle(Plane=pt_2, XSize=dom_2, YSize=dom, Radius=0)  # -> Rectangle, Length
arrrec = RectangularArray(Geometry=pt_2, Cell=rectangle.Rectangle, XCount=python.a, YCount=python.b)  # -> Geometry, Transform
item = ListItem(List=arrrec.Geometry, Index=1023, Wrap=True)
pt_4 = Point(item)
mirror = Mirror(Geometry=arrrec.Geometry, Plane=xz)  # -> Geometry, Transform
incurve = PointInCurve(Point=mirror.Geometry, Curve=crv_2)  # -> Relationship, Point
python_3 = GhPythonScript(type=txt_2, x=incurve.Relationship)  # -> out, file_path; inputs x: list of Int32
# ---------- python_3: Python ----------
__author__ = "Platina"
__version__ = "2021.07.19"

import rhinoscriptsyntax as rs
import System

a = System.Drawing.Bitmap(512,1024)

count = 0
for i in range(512):
    for j in range(1024):
        if x[count]==2:
            a.SetPixel(i,j,System.Drawing.Color.FromArgb(0,0,0))
        else:
            a.SetPixel(i,j,System.Drawing.Color.FromArgb(255,255,255))
        count += 1

a.RotateFlip(System.Drawing.RotateFlipType.Rotate90FlipX)

file_path = "C:\\AIStructureGenerator\\datasets\\test.jpg"

System.Drawing.Bitmap.Save(a,file_path)

if type=="DragonflyWings":
    file_path = "C:\\AIStructureGenerator\\datasets\\fmb_to_fcb\\test_A\\test.jpg"
elif type=="DamselflyWings":
    file_path = "C:\\AIStructureGenerator\\datasets\\Damselfly_1\\test_A\\test.jpg"
elif type=="GrasshopperWings":
    file_path = "C:\\AIStructureGenerator\\datasets\\GH_1\\test_A\\test.jpg"
elif type=="AmazonWaterLily":
    file_path = "C:\\AIStructureGenerator\\datasets\\AWL_1\\test_A\\test.jpg"

System.Drawing.Bitmap.Save(a,file_path)
# ---------- end python_3 ----------
file_path = ClusterOutput(python_3.file_path)
pt_5 = ClusterOutput(pt_4)
pt_6 = ClusterOutput(pt_3)
pt_7 = ClusterOutput(pt_2)

# ==== cluster Generate_Dual
crv = ClusterInput()
crv_2 = Curve(crv)
crv_3 = Curve(crv_2)

grid_divisions = Integer(20)
crv_4 = Curve(simplify(crv_3))
x_bounds = Domain(Domain(1950, 3650))
y_bounds = Domain(Domain(2750, 3550))

dom² = Domain²(DomainU=x_bounds, DomainV=y_bounds)
hem_open_xy_networks = VBScript(seg=crv_4, bnd=dom², sbdv=grid_divisions)  # -> out, flatten(e), flatten(eOV), flatten(ePE), flatten(eNE), flatten(eTE), flatten(eIF), flatten(v)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; inputs seg: list of Curve
# ---------- hem_open_xy_networks: VB ----------
    Dim edgeList As New list(Of Line)
    Dim eOVlist As New dataTree(Of int32)
    Dim ePElist As New dataTree(Of int32)
    Dim eNElist As New dataTree(Of int32)
    Dim eTElist As New list(Of int32)
    Dim eIFlist As New list(Of int32)
    Dim vtxList As New list(Of point3d)
    Dim vIElist As New list(Of int32)
    Dim fList As New datatree(Of point3d)
    Dim fIElist As New dataTree(Of int32)

    Dim vIEall As New dataTree(Of int32)
    Dim eF As New list(Of Boolean)

    Dim eDegList As New List(Of Double)

    '********FOR EACH SEGMENT, ADD EDGE AND ITS REVERSE (twin) TO edgeList********
    Dim segCt As int32 = 0
    For i As int32=0 To seg.count - 1
      If seg(i).pointAtStart.distanceto(seg(i).pointAtEnd) > 0 Then
        edgeList.add(New Line(seg(i).pointAtStart, seg(i).pointAtEnd))
        edgeList.add(New Line(seg(i).pointAtEnd, seg(i).pointAtStart))
        eTEList.add((segCt * 2) + 1)
        eTEList.add((segCt * 2))
        'DEFAULT SETTING FOR ef IS TRUE (ie EDGE NEEDS TO BE ASSIGNED TO A FACE)
        ef.add(True)
        ef.add(True)
        eIFlist.add(-10)
        eIFlist.add(-10)

        EdgeDirection(edgeList(edgeList.count - 2), eDegList)
        segCt += 1
      End If
    Next

    Dim vtxTree As New dataTree(Of point3d)
    Dim vNdxTree As New dataTree(Of Int32)
    For i As int32=0 To sbdv - 1
      For j As int32=0 To sbdv - 1
        vtxTree.ensurepath(New gh_path(i, j))
        vNdxTree.ensurepath(New gh_path(i, j))
      Next
    Next


    '********CONSTRUCT VERTEX LIST FROM LIST OF HALF-EDGES********
    For i As int32=0 To edgeList.count - 1
      'boolCk = (is there a close point?, what is the index)
      Dim boolCk() As int32 = {0,-10}

      Dim vCt As int32 = vtxTree.datacount
      CheckLinePt(edgeList(i), vtxTree, vNdxTree, boolCk, bnd, sbdv, 0)

      'IF A NEW VERTEX WAS ADDED, THEN ADD EDGE INDEX TO vIE, vIEall, AND eOV
      If vtxTree.datacount > vCt Then
        vIElist.add(i)
        vIEall.add(i, New GH_Path(boolCk(1)))
        eOVlist.add(boolCk(1), New GH_Path(i))

      Else If boolCK(1) >= 0 Then
        vIEall.add(i, New GH_Path(boolCK(1)))
        eOVlist.add(boolCK(1), New GH_Path(i))
      End If
    Next



    '********FROM EACH HALF-EDGE..
    For i As int32=0 To edgeList.count - 1
      Dim boolCk() As int32 = {0,-10}
      'FIND VERTEX CORRESPONDING TO ENDPOINT (=boolCk(1))
      CheckLinePt(edgeList(i), vtxTree, vNdxTree, boolCk, bnd, sbdv, 1)

      'boolCk(1)=TARGET VERTEX, CHECK ANGLE OF ALL EDGES LEAVING THIS VERTEX
      Dim nxtVtxPth As New gh_path(boolCk(1))
      Dim angCk As Double = -100
      Dim ndx As int32 = -10
      'Dim xProd As vector3d = vector3d.CrossProduct(edgeList(i).direction, vector3d.ZAxis)



      '..FIND NEXT EDGE********
      For j As int32=0 To vIEall.branch(nxtVtxPth).count - 1
        If i <> eTElist(vIEall(nxtVtxPth, j)) Then
          Dim ang As Double = eDegList(eTElist(i)) - eDegList(vIEall(nxtVtxPth, j))
          If ang < 0 Then ang += 360
          If ang > angCk  Then
            angCk = ang
            ndx = j
          End If
        End If
      Next

      If ndx >= 0 Then
        eNElist.add(vIEall(nxtVtxPth, ndx), New GH_Path(i))
        ePElist.add(i, New GH_Path(vIEall(nxtVtxPth, ndx)))
      Else
        'NO NEXT EDGE FOUND, THEN NEXT EDGE IS TWIN
        angCk = math.PI
        ndx = eTElist(i)
        eNElist.add(eTElist(i), New GH_Path(i))
        ePElist.add(i, New GH_Path(eTElist(i)))
      End If
    Next



    '********FIND EDGE-LOOPS / 'FACES'********
    Dim faceCt As int32 = 0
    For i As int32=0 To edgeList.count - 1
      If ef(i) Then
        fList.add(edgeList(i).pointAt(0), New gh_path(faceCt))
        fIEList.add(i, New gh_path(faceCt))
        eIFlist(i) = faceCt
        ef(i) = False
        loopFace(edgeList, ef, eNElist, eNElist(New GH_Path(i), 0), i, fIElist, fList, eIFlist, faceCt)
        faceCt += 1
      End If
    Next


    '********CONVERT vtxTree (SORTED IN BRANCHES BY LOCATION IN GRID)TO LIST (IN ORDER OF INDEX VALUE)********
    For i As int32=0 To vtxTree.datacount - 1
      vtxList.add(Nothing)
    Next
    For i As int32=0 To vtxTree.datacount - 1
      Dim sortNdx As int32 = vNdxTree.alldata(i)
      vtxList(sortNdx) = vtxTree.alldata(i)
    Next

    e = edgeList
    eOV = eOVlist
    eNE = eNElist
    ePE = ePElist
    eTE = eTElist
    eIF = eIFlist
    v = vtxList ' vtxTree
    vIE = vIEall
    f = fList
    fIE = fIElist

    '********PRINT HEM STATS********
    print(vtxList.count & " vertices")
    print(faceCt & " faces")
    print(edgeList.count & " ½ edges")
# ---------- hem_open_xy_networks: VB additional code ----------
  Sub CheckLinePt(ByVal eCurr As Line, ByRef vTree As datatree(Of point3d), ByRef nTree As datatree (Of int32), ByRef ck As Array, ByVal dom As UVInterval, ByVal div As int32, ByVal t As Double)
    'WHEN t=0: CHECKING START POINT; WHEN t=1: CHECKING END POINT
    Dim ptCk As New point3d(eCurr.PointAt(t))

    'POINT VALUE (MINUS DOMAIN STARTING POINT) DIVIDED BY STEP, FLOORED
    Dim pthX As int32 = Math.floor((ptCk.X - dom.u0) / ((dom.U1 - dom.U0) / div))
    Dim pthY As int32 = Math.floor((ptCk.y - dom.v0) / ((dom.v1 - dom.v0) / div))
    pthX = math.min(math.Max(pthX, 0), div - 1)
    pthY = math.min(math.Max(pthY, 0), div - 1)
    Dim pthXY As New gh_path(pthX, pthY)
    ck(1) = -10

    'CHECK ALREADY ADDED NODES
    If vTree.pathExists(pthXY) Then
      For j As int32=0 To vTree.branch(pthXY).count - 1
        If ptCk.DistanceTo(vTree(pthXY, j)) < .1 Then
          ck(0) += 1
          ck(1) = nTree(pthXY, j)
          Exit For
        End If
      Next
    End If

    'IF NOT ALREADY ADDED, THEN ADD
    If  ck(0) = 0 AndAlso ck(1) < 0 Then
      ck(1) = vTree.datacount
      nTree.add(vTree.datacount, pthXY)
      vTree.add(ptCk, pthXY)
    End If

  End Sub


  Sub EdgeDirection(ByRef eCurr As Line, ByRef degList As List(Of Double))
    'FIND DIRECTION OF EDGE
    Dim deg As Double
    If eCurr.direction.x = 0 Then
      deg = (90 * (eCurr.Direction.Y / math.abs(eCurr.Direction.Y))) + 360
      deg = (360 + deg) Mod 360
    Else
      deg = ((math.atan(eCurr.Direction.Y / eCurr.Direction.x)) * 180 / math.PI)
      If eCurr.Direction.X < 0 Then deg = 180 + deg
      If eCurr.Direction.X > 0  Then deg = (360 + deg) Mod 360
    End If

    degList.add(deg)
    degList.add((deg + 180) Mod 360)
  End Sub


  Sub loopFace(ByVal eList As list(Of line), ByRef ck As list(Of Boolean), ByVal eNE As datatree(Of int32), ByVal n As int32, ByVal init As int32, ByRef fList As datatree(Of int32), ByRef f As datatree(Of point3d), ByRef efList As List(Of int32), ByRef ct As int32)
    If n <> init Then
      f.add(eList(n).pointAt(0), New gh_path(ct))
      fList.add(n, New gh_path(ct))
      efList(n) = ct
      ck(n) = False
      loopFace(eList, ck, eNE, eNE(New GH_Path(n), 0), init, fList, f, efList, ct)
    End If
  End Sub
# ---------- end hem_open_xy_networks ----------
pline = PolyLine(Vertices=hem_open_xy_networks.f, Closed=True)
flatten = FlattenTree(Tree=pline, Path="{0}")
srf = Surface(flatten)
area = Area(Geometry=srf)  # -> Area, Centroid
sort = SortList(Keys=area.Area, ValuesA=flatten)  # -> Keys, ValuesA

# ---- group: make lines to polygons
shift = ShiftList(List=sort.ValuesA, Shift=-1, Wrap=False)

# ----
graft = GraftTree(Tree=shift, IncludeEmptyLists=True, IncludeNullItems=True)
boundary = BoundarySurfaces(Edges=graft)  # -> flatten(Surfaces)
srf_2 = Surface(boundary)
Z = UnitZ(Factor=50)
extr = Extrude(Base=srf_2, Direction=Vector(0, 0, -100))
bool = ClusterInput()
move = Move(Geometry=extr, Motion=Z)  # -> Geometry, Transform
bool_2 = Boolean(bool)
python = GhPythonScript(run=bool_2, geo=move.Geometry)  # -> out, Form_InternalLines; inputs geo: list of Brep
# ---------- python: Python ----------
__author__ = "Hao"
__version__ = "2018.1.28"


import rhinoscriptsyntax as rs
import scriptcontext as sc
import Rhino
import ghpythonlib.treehelpers as ghtree
import math
import ghpythonlib.components as gh

import clr
import os
import time
clr.AddReferenceToFileAndPath("C:\\PolyFramework\\PolyFramework.dll")

import Rhino.Geometry as rg
import PolyFramework as pf

if run:
    
    sc.doc = Rhino.RhinoDoc.ActiveDoc
    rhdoc = Rhino.RhinoDoc.ActiveDoc
    
    rs.AddLayer("temp")
    a = rs.ObjectsByLayer("temp")
    rs.DeleteObjects(a)
    
    rl = Rhino.DocObjects.ObjectAttributes()
    rl.LayerIndex = rhdoc.Layers.FindName("temp").Index
    for geoi in geo:
        rhdoc.Objects.Add(geoi,rl)
    
    rs.Command("_SelLayerNumber "+str(rhdoc.Layers.FindName("temp").Index))
    rs.Command("PFBuild _Enter _Enter _Enter")
    rs.Command("_SelLayerNumber "+str(rhdoc.Layers.FindName("_Force_Lines").Index))
    rs.Command("PFDual _Enter _Enter _Enter _Enter")
    
    Form_InternalLines = rs.ObjectsByLayer("_Form_InternalLines")
# ---------- end python ----------
form_internallines = ClusterOutput(python.Form_InternalLines)

# ==== cluster Generate_ANN_Input
bool = ClusterInput()
crv = ClusterInput()
bool_2 = Boolean(bool)
crv_2 = Curve(crv)
python = GhPythonScript(Form_InternalLines=crv_2, pleaserun=bool_2)  # -> out, linestemp, edgetemp, facetemp; inputs Form_InternalLines: list of Curve, pleaserun: Boolean
# ---------- python: Python ----------
__author__ = "Platina"
__version__ = "2019.12.15"

import rhinoscriptsyntax as rs
import scriptcontext as sc
import Rhino
import ghpythonlib.treehelpers as ghtree
import math
import ghpythonlib.components as gh

import clr
import os
import time
clr.AddReferenceToFileAndPath("C:\\PolyFramework\\PolyFramework.dll")

import Rhino.Geometry as rg
import PolyFramework as pf

if pleaserun:
    rhdoc = Rhino.RhinoDoc.ActiveDoc
    linestemp = []
    edgetemp = []
    facetemp = []
    rs.Command("_SelLayerNumber "+str(rhdoc.Layers.FindName("_Form_InternalLines").Index))
    primal = pf.PFoam()
    dual = pf.PFoam()
    containerType = pf.ContainerType
    multiData = pf.LoadData.LoadPrimalDual(True)
    guids = multiData[0]
    primal = multiData[1]
    dual = multiData[2]
    containerType = multiData[3]
    for edge in primal.Edges:
        if (edge.Dual) and (edge.Id>=0):
            if (edge.GetLength()>0) and (edge.Dual.Area>0):
                linestemp.append(edge.CreateLine())
                edgelength = edge.GetLength()
                edgetemp.append(edge.GetLength())
                facearea = edge.Dual.Area
                facetemp.append(edge.Dual.Area)
# ---------- end python ----------
curvepoint = PointOnCurve(python.linestemp, parameter=0.5)
curvepoint_2 = PointOnCurve(crv_2, parameter=0.5)
cp = ClosestPoint(Point=curvepoint_2, Cloud=curvepoint)  # -> ClosestPoint, CPIndex, Distance
item = ListItem(List=python.facetemp, Index=cp.CPIndex, Wrap=True)
end = EndPoints(Curve=crv_2)  # -> Start, End
pdecon = Deconstruct(Point=end.Start)  # -> XComponent, YComponent, ZComponent
pdecon_2 = Deconstruct(Point=end.End)  # -> XComponent, YComponent, ZComponent
merge = Merge(
    Data1=simplify(graft(pdecon.XComponent)),
    Data2=simplify(graft(pdecon.YComponent)),
    Data3=simplify(graft(pdecon_2.XComponent)),
    Data4=simplify(graft(pdecon_2.YComponent)),
    Data5=simplify(graft(item)))
merge_2 = Merge(
    Data1=simplify(graft(pdecon_2.XComponent)),
    Data2=simplify(graft(pdecon_2.YComponent)),
    Data3=simplify(graft(pdecon.XComponent)),
    Data4=simplify(graft(pdecon.YComponent)),
    Data5=simplify(graft(item)))
join = TextJoin(Text=merge_2, Join=",")  # -> flatten(Result)
join_2 = TextJoin(Text=merge, Join=",")  # -> flatten(Result)
merge_3 = Merge(Data1=join_2, Data2=join)  # -> flatten(Result)
panel = Panel(merge_3)
python_2 = FileCreator(name="C:\AIStructureGenerator\ANN\pre", ext="csv", lines=merge_3, write=bool_2)  # -> file_path; inputs lines: list, write: Boolean
# ---------- python_2: Python ----------
"""
Creates a file with a given ndame and extension.
    Inputs:
        name: Desired file name.
        ext: Desired file extension.
        lines: Text to write.
        write: Set to True to write.
"""

# Stephen P. Maher /  2015

ghenv.Component.Name = "File Creator"

import Grasshopper as gh
import os

gh_path = ghdoc.Path # Get GH file path
file = os.path.dirname(os.path.realpath(gh_path)) # Get GH file directory to save to

if "." not in ext: ext = "." + ext
else: pass

#if os.path.exists(file) == False: # Test if file already exists; if it doesn't, proceed
file = name + ext # Set file name and extension
#if os.path.exists(file) == True: # If it does exists, follow the next steps
#    file_count = len([f for f in os.walk(".").next()[2] if f[-4:] == ext]) # Find all files with the same extension
#    file = name + "_" + str(file_count) + ext # Add the number to the new file name as a differentiator

if write:
    filePath = open(file, "w") # Open the file
    for line in lines: # Iterate through lines
        filePath.write(line + "\n") # Write separate lines
    filePath.close() # Close the file
else:
    msg = "Set 'write' to True."
    ghenv.Component.AddRuntimeMessage(gh.Kernel.GH_RuntimeMessageLevel.Warning, msg)

file_path = file
# ---------- end python_2 ----------
file_path = ClusterOutput(python_2)

# ==== cluster Generate_Structural_Form
pleaserun = ClusterInput()
F = ClusterInput()
F_2 = ClusterInput()
crv = ClusterInput()
python = GhPythonScript(file_path=F, run=pleaserun)  # -> out, a; inputs run: Boolean; disabled
# ---------- python: Python ----------
__author__ = "Platina"
__version__ = "2021.07.19"

import rhinoscriptsyntax as rs
import csv
import ghpythonlib.treehelpers as ghtree

if run:
    with open(file_path, 'r') as f:
        a = []
        reader = csv.reader(f)
        for row in reader:
            temp = float(row[0])
            a.append(temp)
    
    a = ghtree.list_to_tree(a)
# ---------- end python ----------
file = ReadFile(File=F, PerLineParse=True)
file_2 = ReadFile(File=F_2, PerLineParse=True)
crv_2 = Curve(crv)
split = TextSplit(Text=file_2, Separators=",")
num = Number(file)
crv_3 = ClusterInput()
num_2 = Number(split)
crv_4 = Curve(crv_3)
lng = ListLength(List=crv_4)
lng_2 = ListLength(List=num)
dup = DuplicateData(Data=0.5, Number=lng, Order=True)
division = Division(A=lng_2, B=2)
python_2 = GhPythonScript(x=dup, y=num_2)  # -> out, a; inputs x: list, y: list
# ---------- python_2: Python ----------
__author__ = "Platina"
__version__ = "2021.08.16"

import rhinoscriptsyntax as rs

if y==[]:
    a = x
else:
    a = y
# ---------- end python_2 ----------
boundary = BoundarySurfaces(Edges=crv_4)
subtraction = Subtraction(A=division, B=1)
crv_5 = Curve(boundary)
dom = ConstructDomain(DomainStart=0, DomainEnd=subtraction)
subset = SubList(List=num, Domain=dom, Wrap=True)  # -> List, Index
explode = Explode(Curve=crv_5, Recursive=True)  # -> Segments, Vertices
num_3 = ClusterInput()
pt = Point(explode.Vertices)
divide = DivideCurve(Curve=crv_2, Count=100, Kinks=False)  # -> Points, Tangents, Parameters
data = Data(subset.List)
num_4 = Number(num_3)
python_3 = GhPythonScript(pleaserun=pleaserun, constraint=divide.Points, marker=pt, ori=crv_4, ori_len=data, tor=num_4, ran=python_2.a)  # -> out, bakeout; inputs constraint: list of Point3d, marker: list of Point3d, ori: list of Curve, ori_len: list, ran: list
# ---------- python_3: Python ----------
__author__ = "Hao"
__version__ = "2018.1.28"


import rhinoscriptsyntax as rs
import scriptcontext as sc
import Rhino
import ghpythonlib.treehelpers as ghtree
import math
import ghpythonlib.components as gh

import clr
import os
import time
clr.AddReferenceToFileAndPath("C:\\PolyFramework\\PolyFramework.dll")

import Rhino.Geometry as rg
import PolyFramework as pf

if pleaserun :
    
    cir = gh.Interpolate(constraint,3,True)[0]
    
    InternalLines = []
    ExternalForces = []
    ExternalPoly = []
    
    edgelengths = []
    faceareas = []
    lines = []
    mibfs = []
    primals = []
    
    countc = 0
    
    sc.doc = Rhino.RhinoDoc.ActiveDoc
    rhdoc = Rhino.RhinoDoc.ActiveDoc
    rs.Command("_SelLayerNumber "+str(rhdoc.Layers.FindName("_Form_InternalLines").Index))
    primal = pf.PFoam()
    dual = pf.PFoam()
    containerType = pf.ContainerType
    multiData = pf.LoadData.LoadPrimalDual(True)
    guids = multiData[0]
    primal = multiData[1]
    dual = multiData[2]
    containerType = multiData[3]
    geoouttemp = rs.ObjectsByLayer('_Form_ExternalForces')
    geoouttemp = [rs.coercecurve(j) for j in geoouttemp]
    ExternalForcestemp = geoouttemp
    pt1 = gh.EndPoints(ExternalForcestemp)[0]
    pt2 = gh.EndPoints(ExternalForcestemp)[1]
    pt1.extend(pt2)
    ptall = pt1
    result = []
    for i in range(len(ptall)):
        for j in range(len(marker)):
            if rs.Distance(ptall[i],marker[j])<0.01:
                result.append(ptall[i])
                break
    pickedVertsup = []
    fixableVerts ={}
    result2 = []
    for vert in primal.Vertices:
        id = vert.Id
        location = vert.Point
        for i in range(len(result)):
            if rs.Distance(result[i],location)<0.01:
                fixableVerts[location] = vert
                pickedVertsup.append(fixableVerts[location])
                primal.SetVertexConstraints([fixableVerts[location]], cir, 1.0, True)
                result2.append(location)
                break
                
    stpp = []
    enpp = []
    for i in range(len(ori)):
        temp = gh.EndPoints(ori[i])
        stpp.append(temp[0])
        enpp.append(temp[1])
    for edge in primal.Edges:
        for i in range(len(ori)):
            if (rs.Distance(stpp[i],edge.Vertices[0].Point)<0.01) and (rs.Distance(enpp[i],edge.Vertices[1].Point)<0.01) or (rs.Distance(stpp[i],edge.Vertices[1].Point)<0.01) and (rs.Distance(enpp[i],edge.Vertices[1].Point)<0.01):
                   edge.MinLength = (0.5+ran[i]*1.0)*ori_len[i]*(1.0-tor)
                   edge.MaxLength = (0.5+ran[i]*1.0)*ori_len[i]*(1.0+tor)
    
    primal.PerpSoft(maxSteps = 10000)
    bakeout = pf.PFoam.SaveAsEdges(primal)
# ---------- end python_3 ----------

# ==== cluster Select_mode
G = ClusterInput()
brec = BoundingRectangle(Geometry=G, Plane=PlaneXY(0, 0, 0), Axis=0, Slide=0, Union=True)  # -> Bounding, DimensionX, DimensionY
explode = Explode(Curve=brec.Bounding, Recursive=True)  # -> Segments, Vertices
mode = ClusterInput()
item = ListItem(List=explode.Segments, Index=0, Wrap=True)  # -> Item, Item1
len = Length(Curve=item.Item)
len_2 = Length(Curve=item.Item1)
division = Division(A=len, B=len_2)
select_type = GhPythonScript(ratio=division, mode=mode)  # -> out, type
# ---------- select_type: Python ----------
__author__ = "Platina"
__version__ = "2021.07.24"

import rhinoscriptsyntax as rs
import ghpythonlib.components as gh

a = [1.0,1.8,3.5,4.4]
b = ["AmazonWaterLily","GrasshopperWings","DragonflyWings","DamselflyWings"]

if mode!="AutoMode":
    type = mode
else:
    if ratio<1.4:
        type = "AmazonWaterLily"
    elif ratio<2.65:
        type = "GrasshopperWings"
    elif ratio<3.95:
        type = "DragonflyWings"
    else:
        type = "DamselflyWings"
# ---------- end select_type ----------
type = ClusterOutput(select_type.type)

# ==== cluster Generate_Force_Geometry
pt = ClusterInput()
pt_2 = ClusterInput()
txt = ClusterInput()
pt_3 = ClusterInput()
bool = ClusterInput()
pt_4 = Point(pt)
pt_5 = Point(pt_2)
txt_2 = Text(txt)
pt_6 = Point(pt_3)
bool_2 = Boolean(bool)
generate_force_geometry = GhPythonScript(pt1=pt_4, file_path=txt_2, run=bool_2)  # -> out, file_path; inputs pt1: Point3d, run: Boolean
# ---------- generate_force_geometry: Python ----------
__author__ = "Platina"
__version__ = "2021.07.19"

import rhinoscriptsyntax as rs
import os

if run:
    
    os.system("cd C:\\AIStructureGenerator && C: && python get_skeleton.py")
    
    file_path = 'C:\\AIStructureGenerator\\results\\result.csv'
# ---------- end generate_force_geometry ----------
dist = Distance(PointA=pt_6, PointB=pt_4)
division = Division(A=dist, B=1024)
file = ReadFile(File=generate_force_geometry.file_path, PerLineParse=True)
split = TextSplit(Text=file, Separators=",")  # -> simplify(Result)
split_2 = TextSplit(Text=split, Separators=" ")  # -> simplify(Result)
split_3 = TextSplit(Text=split_2, Separators=" .")  # -> simplify(Result)
trim = TrimTree(Tree=split_3, Depth=1)
split_4 = TextSplit(Text=trim, Separators="[")  # -> simplify(Result)
trim_2 = TrimTree(Tree=split_4, Depth=1)
split_5 = TextSplit(Text=trim_2, Separators="]")  # -> simplify(Result)
trim_3 = TrimTree(Tree=split_5, Depth=1)
num = Number(trim_3)
panel = Panel(num)
null = NullItem(Item=num)  # -> NullFlags, InvalidFlags, Description
not = GateNot(A=null.NullFlags)
cull = CullPattern(List=num, CullPattern=not)
item = ListItem(List=cull, Index=0, Wrap=True)  # -> Item, Item1
pt_7 = ConstructPoint(XCoordinate=0, YCoordinate=256, ZCoordinate=0)
pt_8 = ConstructPoint(XCoordinate=item.Item1, YCoordinate=item.Item, ZCoordinate=0)
xz = XZPlane(Origin=pt_7)
mirror = Mirror(Geometry=pt_8, Plane=xz)  # -> Geometry, Transform
move = Move(Geometry=mirror.Geometry, Motion=pt_4)  # -> Geometry, Transform
trim_4 = TrimTree(Tree=mirror.Geometry, Depth=1)
pline = PolyLine(Vertices=trim_4, Closed=False)  # -> flatten(Polyline)
len = Length(Curve=pline)  # disabled
end = EndPoints(Curve=pline)  # -> Start, End
graft = GraftTree(Tree=end.End, IncludeEmptyLists=True, IncludeNullItems=True)
graft_2 = GraftTree(Tree=end.Start, IncludeEmptyLists=True, IncludeNullItems=True)
explode = Explode(Curve=pline, Recursive=True)  # -> Segments, Vertices
merge = Merge(Data1=end.Start, Data2=end.End)
graft_3 = GraftTree(Tree=end.End, IncludeEmptyLists=True, IncludeNullItems=True)
ln = Line(StartPoint=end.Start, EndPoint=end.End)
larger = LargerThan(FirstNumber=len, SecondNumber=3)  # -> LargerThan, OrEqualTo; disabled
duppt = RemoveDuplicatePts(Points=merge, Tolerance=0.01)
sort = SortList(Keys=len, ValuesA=pline)  # -> Keys, ValuesA; disabled
python = GhPythonScript(x=explode.Vertices, y=pline)  # -> out, a; inputs x: tree of Point3d, y: list of Curve; disabled
# ---------- python: Python ----------
__author__ = "Platina"
__version__ = "2021.07.24"

import rhinoscriptsyntax as rs
import ghpythonlib.treehelpers as ghtree

x = ghtree.tree_to_list(x)

a = []
for i in range(len(y)):
    q = 0
    p = 3
    while p<=len(x[i])-1:
        c = rs.AddLine(x[i][q],x[i][p])
        temp = rs.CurveCurveIntersection(c,y[i])
        if (temp==None) or (len(temp)<=2):
            a.append(c)
            q = p
            p += 2
        p += 1
    if q!=len(x[i])-1:
        a.append(rs.AddLine(x[i][q],x[i][len(x[i])-1]))
# ---------- end python ----------
divlength = DivideLength(Curve=pline, Length=50)  # -> Points, Tangents, Parameters
duppt_2 = RemoveDuplicatePts(Points=duppt, Tolerance=6)
cp = ClosestPoint(Point=graft, Cloud=duppt_2)  # -> ClosestPoint, CPIndex, Distance
cp_2 = ClosestPoint(Point=graft_2, Cloud=duppt_2)  # -> ClosestPoint, CPIndex, Distance
ln_2 = Line(StartPoint=cp_2.ClosestPoint, EndPoint=cp.ClosestPoint)  # -> flatten(Line)
len_2 = Length(Curve=ln_2)
larger_2 = LargerThan(FirstNumber=len_2, SecondNumber=0.01)  # -> LargerThan, OrEqualTo
rev = ReverseList(List=sort.ValuesA)  # disabled
cull_2 = CullPattern(List=pline, CullPattern=larger.LargerThan)  # disabled
len_3 = Length(Curve=python.a)  # disabled
merge_2 = Merge(Data1=divlength.Points, Data2=graft_3)
larger_3 = LargerThan(FirstNumber=len_3, SecondNumber=0.01)  # -> LargerThan, OrEqualTo; disabled
cull_3 = CullPattern(List=ln_2, CullPattern=larger_2.LargerThan)
dupln = RemoveDuplicateLines(Lines=cull_3, Tolerance=0.01)
end_2 = EndPoints(Curve=dupln)  # -> Start, End
merge_3 = Merge(Data1=end_2.Start, Data2=end_2.End)
cull_4 = CullPattern(List=python.a, CullPattern=larger_3.LargerThan)  # disabled
pline_2 = PolyLine(Vertices=merge_2, Closed=False)  # -> flatten(Polyline)
explode_2 = Explode(Curve=rev, Recursive=True)  # -> Segments, Vertices; disabled
duppt_3 = RemoveDuplicatePts(Points=merge_3, Tolerance=0.01)
explode_3 = Explode(Curve=pline_2, Recursive=True)  # -> flatten(Segments), Vertices
len_4 = Length(Curve=explode_3.Segments)
flatten = FlattenTree(Tree=explode_2.Segments, Path="{0}")  # disabled
larger_4 = LargerThan(FirstNumber=len_4, SecondNumber=0.01)  # -> LargerThan, OrEqualTo
cull_5 = CullPattern(List=explode_3.Segments, CullPattern=larger_4.LargerThan)
cps = ClosestPoints(Point=duppt_3, Cloud=merge_3, Count=3)  # -> ClosestPoint, CPIndex, Distance
dupln_2 = RemoveDuplicateLines(Lines=flatten, Tolerance=0.01)  # disabled
dupln_3 = RemoveDuplicateLines(Lines=cull_5, Tolerance=0.01)
crv = Curve(dupln_3)
remove_1 = Remove1(C=crv)
remove_1_2 = Remove1(C=remove_1)
remove_1_3 = Remove1(C=remove_1_2)
remove_1_4 = Remove1(C=remove_1_3)
remove_1_5 = Remove1(C=remove_1_4)
remove_1_6 = Remove1(C=remove_1_5)
remove_1_7 = Remove1(C=remove_1_6)
remove_1_8 = Remove1(C=remove_1_7)
remove_2 = Remove2(C=remove_1_8)
remove_2_2 = Remove2(C=remove_2)
remove_2_3 = Remove2(C=remove_2_2)
remove_2_4 = Remove2(C=remove_2_3)
remove_2_5 = Remove2(C=remove_2_4)
item_2 = ListItem(List=cps.Distance, Index=-1, Wrap=True)
remove_2_6 = Remove2(C=remove_2_5)
toggle = BooleanToggle(True)  # disabled
subset = SubList(List=cull_4, Domain=Domain(0, 100), Wrap=True)  # -> List, Index; disabled
scale = Scale(Geometry=dupln_2, Center=pt_4, Factor=division)  # -> Geometry, Transform; disabled
smaller = SmallerThan(FirstNumber=item_2, SecondNumber=0.01)  # -> flatten(SmallerThan), OrEqualTo
remove_2_7 = Remove2(C=remove_2_6)
toggle_2 = BooleanToggle(True)  # disabled
cull_6 = CullPattern(List=duppt_3, CullPattern=smaller.SmallerThan)
cp_3 = ClosestPoint(Point=end_2.Start, Cloud=cull_6)  # -> ClosestPoint, CPIndex, Distance
cp_4 = ClosestPoint(Point=end_2.End, Cloud=cull_6)  # -> ClosestPoint, CPIndex, Distance
smaller_2 = SmallerThan(FirstNumber=cp_3.Distance, SecondNumber=0.01)  # -> SmallerThan, OrEqualTo
smaller_3 = SmallerThan(FirstNumber=cp_4.Distance, SecondNumber=0.01)  # -> SmallerThan, OrEqualTo
and = GateAnd(A=smaller_2.SmallerThan, B=smaller_3.SmallerThan)
cull_7 = CullPattern(List=dupln, CullPattern=and)
python_2 = GhPythonScript(curves=cull_4, run=toggle)  # -> out, curves; inputs curves: list of Curve, run: Boolean; disabled
# ---------- python_2: Python ----------
__author__ = "Platina"
__version__ = "2021.07.24"

import rhinoscriptsyntax as rs
import ghpythonlib.components as gh

if run:
    for i in range(len(curves)):
        spp = rs.CurveStartPoint(curves[i])
        epp = rs.CurveEndPoint(curves[i])
        l = rs.CurveLength(curves[i])
        curve = rs.ScaleObject(curves[i],rs.CurveMidPoint(curves[i]),[1024/l,1024/l,1024/l])
        sp = rs.CurveStartPoint(curve)
        ep = rs.CurveEndPoint(curve)
        a = [sp,ep]
        for j in range(len(curves)):
            if i!=j:
                temp = rs.CurveCurveIntersection(curve,curves[j])
                if temp!=None:
                    a.append(temp[0][1])
        d = gh.Distance(a,sp)
        a = gh.SortList(d,a)[1]
        minep = 9999
        minsp = 9999
        epf = None
        spf = None
        for j in range(len(a)):
            if abs((rs.Distance(a[j],epp)-rs.Distance(a[j],spp))-l)<0.01:
                ll = rs.Distance(a[j],spp)
                if ll<minsp:
                    minsp = ll
                    spf = a[j]
            if abs((rs.Distance(a[j],spp)-rs.Distance(a[j],epp))-l)<0.01:
                ll = rs.Distance(a[j],epp)
                if ll<minep:
                    minep = ll
                    epf = a[j]
        curves[i] = rs.AddLine(spf,epf)
# ---------- end python_2 ----------
slider = Slider(0.001, range=0..0.001)  # disabled
remove_2_8 = Remove2(C=remove_2_7)
rotate = Rotate(Geometry=python_2.curves, Angle=0.6283185307, Plane=PlaneXY(0, 0, 0))  # -> Geometry, Transform; disabled
scale_2 = Scale(Geometry=cull_6, Center=pt_4, Factor=division)  # -> Geometry, Transform
toggle_3 = BooleanToggle(False)  # disabled
del = DelaunayMesh(Points=cull_6, Plane=PlaneXY(0, 0, 0))
python_3 = GhPythonScript(curves=subset.List, run=toggle_2)  # -> out, curves; inputs curves: list of Curve, run: Boolean; disabled
# ---------- python_3: Python ----------
__author__ = "Platina"
__version__ = "2021.07.24"

import rhinoscriptsyntax as rs

if run:
    for i in range(len(curves)):
        curve = curves[i]
        pds = False
        pde = False
        pdsp = None
        pdep = None
        s1 = rs.CurveStartPoint(curve)
        e1 = rs.CurveEndPoint(curve)
        temp = []
        for j in range(len(curves)):
            if i!=j:
                if rs.Distance(rs.EvaluateCurve(curves[j],rs.CurveClosestPoint(curves[j],s1)),s1)<50:
                    temp.append(curves[j])
                elif rs.Distance(rs.EvaluateCurve(curves[j],rs.CurveClosestPoint(curves[j],e1)),e1)<50:
                    temp.append(curves[j])
        for j in range(len(temp)):
            a = rs.CurveCurveIntersection(curve,temp[j])
            if a!=None:
                if rs.Distance(a[0][1],rs.CurveStartPoint(curve))<0.01:
                    pds = True
                    pdsp = a[0][1]
                if rs.Distance(a[0][1],rs.CurveEndPoint(curve))<0.01:
                    pde = True
                    pdep = a[0][1]
            if (pds==True) and (pde==True):
                break
        count = 0
        while ((pds==False) or (pde==False)) and (count<50):
            if pds==False:
                l = (rs.CurveLength(curve)+1)/rs.CurveLength(curve)
                curve = rs.ScaleObject(curve,rs.CurveEndPoint(curve),[l,l,l])
                for j in range(len(temp)):
                    a = rs.CurveCurveIntersection(curve,temp[j])
                    if a!=None:
                        if rs.Distance(a[0][1],rs.CurveStartPoint(curve))<=1:
                            pds = True
                            pdsp = a[0][1]
                            break
            if pde==False:
                l = (rs.CurveLength(curve)+1)/rs.CurveLength(curve)
                curve = rs.ScaleObject(curve,rs.CurveStartPoint(curve),[l,l,l])
                for j in range(len(temp)):
                    a = rs.CurveCurveIntersection(curve,temp[j])
                    if a!=None:
                        if rs.Distance(a[0][1],rs.CurveEndPoint(curve))<=1:
                            pde = True
                            pdep = a[0][1]
                            break
            count += 1
        if pdsp==None:
            pdsp = rs.CurveStartPoint(curve)
        if pdep==None:
            pdep = rs.CurveEndPoint(curve)
        curves[i] = rs.AddCurve([pdsp,pdep])
# ---------- end python_3 ----------
end_3 = EndPoints(Curve=python_2.curves)  # -> Start, End; disabled
wbedges = WeaverbirdsMeshEdges(MeshOrPolylines=del)
move_2 = Move(Geometry=del, Motion=pt_4)  # -> Geometry, Transform
python_4 = GhPythonScript(curves=python_2.curves, run=toggle_3)  # -> out, curves; inputs curves: list of Curve, run: Boolean; disabled
# ---------- python_4: Python ----------
__author__ = "Platina"
__version__ = "2021.07.25"

import rhinoscriptsyntax as rs
import ghpythonlib.components as gh

if run:
    pd = True
    while pd==True:
        pd = False
        a = []
        for i in range(len(curves)):
            a.append(rs.CurveEndPoint(curves[i]))
            a.append(rs.CurveStartPoint(curves[i]))
        pp = []
        for i in range(len(curves)):
            d = gh.ClosestPoints(rs.CurveEndPoint(curves[i]),a,2)[2]
            if d[1]<0.01:
                p1 = True
            else:
                p1 = False
            d = gh.ClosestPoints(rs.CurveStartPoint(curves[i]),a,2)[2]
            if d[1]<0.01:
                p2 = True
            else:
                p2 = False
            if p1 and p2:
                pp.append(True)
            else:
                pp.append(False)
                pd = True
        curves = gh.CullPattern(curves,pp)
# ---------- end python_4 ----------
splitcurves = PythonScript(curves=rotate.Geometry, tolerance=slider)  # -> out, pieces; inputs curves: list of Curve; disabled
# ---------- splitcurves: Python ----------
import Rhino
import clr
clr.AddReference("Grasshopper")
from Grasshopper.Kernel.Data import GH_Path
from Grasshopper import DataTree
import ghpythonlib.components as gh


def boxes_overlap(boxA, boxB):
    """Check if there is any overlap between two bounding boxes.
    """
    intersection = boxA.Intersection(boxA, boxB)
    if intersection.IsValid:
        intSize = intersection.Diagonal.Length
        return intSize > 0.0
    else:
        return False

def distribute_intersections(curveIntersections):
    """returns two lists: the parameters on curveA, and the parameters on
    curveB.
    """
    params_a = []
    params_b = []
    for intersection in curveIntersections:
        if not intersection.IsOverlap:
            params_a.append(intersection.ParameterA)
            params_b.append(intersection.ParameterB)
        else: # it's an overlap!
            intervalA = intersection.OverlapA
            intervalB = intersection.OverlapB
            params_a.extend([intervalA.T0, intervalA.T1])
            params_b.extend([intervalB.T0, intervalB.T1])
    return params_a, params_b

def split(curves, tol=0.001):
    """Take a set of curves and split them at every point-type intersection.
    """
    results = []
    parameter_bank = {}
    indices = range(len(curves) - 1, -1, -1)
    for i in indices:
        parameter_bank[i] = []
    for i in indices:
        # check to see if this curve has any previously found intersections
        intersection_parameters = parameter_bank[i]
        if curves:
            curve = curves.pop()
            # check for self intersections first
            self_intersections = Rhino.Geometry.Intersect.Intersection.CurveSelf(curve, tol)
            if self_intersections.Count > 0:
                this_intersect, that_intersect = distribute_intersections(self_intersections)
                intersection_parameters.extend(this_intersect)
                intersection_parameters.extend(that_intersect)
            # check if there are any other curves
            if curves:
                # get the bounding box for this curve
                thisbbox = curve.GetBoundingBox(False)
                # go through the other curves
                for j, other in enumerate(curves):
                    # check if the other curve is anywhere near this one
                    otherbbox = other.GetBoundingBox(False)
                    if boxes_overlap(thisbbox, otherbbox):
                        # get the intersections with the other curve
                        other_intersections = Rhino.Geometry.Intersect.Intersection.CurveCurve( curve,
                                other, tol, tol)
                        if other_intersections.Count > 0:
                            this_intersect, that_intersect = distribute_intersections(other_intersections)
                            intersection_parameters.extend(this_intersect)
                            parameter_bank[j].extend(that_intersect)
        if intersection_parameters:
            # chop up the curve
            curve_pieces = curve.Split(intersection_parameters)
            for curvesss in curve_pieces:
                results.append(gh.Line(curvesss.PointAtStart,curvesss.PointAtEnd))
        else:
            results.append(curve)
    return results

if curves:
    if tolerance == None:
        tolerance = 0.001
    pieces = split(curves, tolerance)
# ---------- end splitcurves ----------
scale_3 = Scale(Geometry=move_2.Geometry, Center=pt_4, Factor=division)  # -> Geometry, Transform
ln_3 = Line(StartPoint=end_3.Start, EndPoint=end_3.End)  # disabled
curvepoint = PointOnCurve(wbedges, parameter=0.5)
splitcurves_2 = PythonScript(curves=remove_2_8, tolerance=Slider(0.001, range=0..0.001))  # -> out, pieces; inputs curves: list of Curve; same code as splitcurves
wbedges_2 = WeaverbirdsMeshEdges(MeshOrPolylines=scale_3.Geometry)
rotate_2 = Rotate(Geometry=splitcurves.pieces, Angle=-0.6283185307, Plane=PlaneXY(0, 0, 0))  # -> Geometry, Transform; disabled
graft_4 = GraftTree(Tree=curvepoint, IncludeEmptyLists=True, IncludeNullItems=True)
len_5 = Length(Curve=rotate_2.Geometry)  # disabled
L = ClusterOutput(wbedges_2)
larger_5 = LargerThan(FirstNumber=len_5, SecondNumber=0.01)  # -> LargerThan, OrEqualTo; disabled
crv_cp = CurveClosestPoint(Point=graft_4, Curve=dupln_3)  # -> Point, Parameter, Distance
dupln_4 = RemoveDuplicateLines(Lines=splitcurves_2.pieces, Tolerance=0.01)
sort_2 = SortList(Keys=crv_cp.Distance, ValuesA=dupln_3)  # -> Keys, ValuesA
cull_8 = CullPattern(List=rotate_2.Geometry, CullPattern=larger_5.LargerThan)  # disabled
crv_2 = Curve(dupln_4)
dupln_5 = RemoveDuplicateLines(Lines=cull_8, Tolerance=0.01)  # disabled
item_3 = ListItem(List=sort_2.ValuesA, Index=0, Wrap=True)  # -> flatten(Item)
len_6 = Length(Curve=dupln_5)  # disabled
crv_3 = Curve(crv_2)
end_4 = EndPoints(Curve=item_3)  # -> Start, End
end_5 = EndPoints(Curve=wbedges)  # -> Start, End
sort_3 = SortList(Keys=len_6, ValuesA=dupln_5)  # -> Keys, ValuesA; disabled
vec2pt = Vector2Pt(PointA=end_4.Start, PointB=end_4.End, Unitize=False)  # -> Vector, Length
vec2pt_2 = Vector2Pt(PointA=end_5.Start, PointB=end_5.End, Unitize=False)  # -> Vector, Length

grid_divisions = Integer(20)
crv_4 = Curve(simplify(crv_3))
x_bounds = Domain(Domain(1950, 3650))
y_bounds = Domain(Domain(2750, 3550))

shift = ShiftList(List=sort_3.Keys, Shift=-1, Wrap=False)  # disabled
lng = ListLength(List=shift)  # disabled
shift_2 = ShiftList(List=sort_3.Keys, Shift=1, Wrap=False)  # disabled
angle = Angle(VectorA=vec2pt.Vector, VectorB=vec2pt_2.Vector)  # -> Angle, Reflex
dom² = Domain²(DomainU=x_bounds, DomainV=y_bounds)
series = Series(Start=0, Step=1, Count=lng)  # disabled
subtraction = Subtraction(A=shift_2, B=shift)  # disabled
division_2 = Division(A=Slider(45, range=0..90), B=180)
subtraction_2 = Subtraction(A=1, B=division_2)
division_3 = Division(A=subtraction, B=shift)  # disabled
multiplication = Multiplication(A=subtraction_2, B=3.141592654)
larger_6 = LargerThan(FirstNumber=angle.Angle, SecondNumber=multiplication)  # -> LargerThan, OrEqualTo
larger_7 = LargerThan(FirstNumber=division_3, SecondNumber=0.3)  # -> LargerThan, OrEqualTo; disabled
multiplication_2 = Multiplication(A=division_2, B=3.141592654)
smaller_4 = SmallerThan(FirstNumber=angle.Angle, SecondNumber=multiplication_2)  # -> SmallerThan, OrEqualTo
or = GateOr(A=smaller_4.SmallerThan, B=larger_6.LargerThan)
hem_open_xy_networks = VBScript(seg=crv_4, bnd=dom², sbdv=grid_divisions)  # -> out, flatten(e), flatten(eOV), flatten(ePE), flatten(eNE), flatten(eTE), flatten(eIF), flatten(v)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; inputs seg: list of Curve; same code as hem_open_xy_networks
cull_9 = CullPattern(List=wbedges, CullPattern=or)
cull_10 = CullPattern(List=series, CullPattern=larger_7.LargerThan)  # disabled
pline_3 = PolyLine(Vertices=hem_open_xy_networks.f, Closed=True)
item_4 = ListItem(List=cull_10, Index=-1, Wrap=True)  # disabled
dom = ConstructDomain(DomainStart=0, DomainEnd=item_4)  # disabled
crv_5 = Curve(cull_9)
flatten_2 = FlattenTree(Tree=pline_3, Path="{0}")
cluster = Cluster(curves=crv_5)
subset_2 = SubList(List=sort_3.ValuesA, Domain=dom, Wrap=True)  # -> List, Index; disabled
srf = Surface(flatten_2)
cluster_2 = Cluster(curves=cluster)
area = Area(Geometry=srf)  # -> Area, Centroid
end_6 = EndPoints(Curve=subset_2.List)  # -> Start, End; disabled
cluster_3 = Cluster(curves=cluster_2)
sort_4 = SortList(Keys=area.Area, ValuesA=flatten_2)  # -> Keys, ValuesA
merge_4 = Merge(Data1=end_6.Start, Data2=end_6.End)  # disabled
cluster_4 = Cluster(curves=cluster_3)
duppt_4 = RemoveDuplicatePts(Points=merge_4, Tolerance=0.01)  # disabled

# ---- group: make lines to polygons
shift_3 = ShiftList(List=sort_4.ValuesA, Shift=-1, Wrap=False)

# ----
cluster_5 = Cluster(curves=cluster_4)
division_4 = Division(A=Slider(15, range=0..90), B=180)
cps_2 = ClosestPoints(Point=duppt_4, Cloud=merge_4, Count=3)  # -> ClosestPoint, CPIndex, Distance; disabled
smaller_5 = SmallerThan(FirstNumber=cps_2.Distance, SecondNumber=0.01)  # -> SmallerThan, OrEqualTo; disabled
multiplication_3 = Multiplication(A=division_4, B=3.141592654)
divide = DivideCurve(Curve=cluster_5, Count=7, Kinks=False)  # -> Points, Tangents, Parameters
toggle_4 = BooleanToggle(False)  # disabled
ma = MassAddition(Input=smaller_5.SmallerThan)  # -> Result, PartialResults; disabled
larger_8 = LargerThan(FirstNumber=ma.Result, SecondNumber=3)  # -> LargerThan, flatten(OrEqualTo); disabled
equals = Equality(FirstNumber=ma.Result, SecondNumber=2)  # -> flatten(Equality), Inequality; disabled
python_5 = GhPythonScript(curves=shift_3, com=dupln_3, rat=multiplication_3)  # -> out, a; inputs curves: list of Curve, com: list of Curve
# ---------- python_5: Python ----------
__author__ = "Platina"
__version__ = "2021.08.01"

import rhinoscriptsyntax as rs
import ghpythonlib.components as gh
import math
import ghpythonlib.treehelpers as ghtree

a = []
for curve in curves:
    temp = gh.Explode(curve,True)[0]
    pts = gh.Explode(curve,True)[1][1:]
    if len(pts)>=4:
        
        okpass = [False for i in range(len(pts))]
        ch = gh.ConvexHull(pts)[0]
        pd = gh.PointInCurve(pts,ch)[0]
        
        for i in range(len(pts)):
            if pd[i]==2:
                for j in range(len(pts)):
                    if i!=j:
                        pp = True
                        l  =gh.Line(pts[i],pts[j])
                        cp = gh.CurveMiddle(l)
                        if gh.PointInCurve(cp,curve)[0]==2:
                            lscale = gh.Scale(l,cp,0.999)[0]
                            for k in temp:
                                if gh.CurveXCurve(lscale,k)[0]!=None:
                                    pp = False
                                    break
                            if pp==True:
                                d = gh.CurveClosestPoint(cp,com)[2]
                                k = gh.SortList(d,com)[1][0]
                                v1 = gh.Vector2Pt(gh.EndPoints(k)[0],gh.EndPoints(k)[1],False)[0]
                                v2 = gh.Vector2Pt(gh.EndPoints(l)[0],gh.EndPoints(l)[1],False)[0]
                                ang = gh.Angle(v1,v2)[0]
                                if ang<rat or ang>math.pi-rat:
                                    temp.append(l)
        
        for i in range(len(pts)):
            if okpass[i]==False:
                for j in range(len(pts)):
                    if i!=j:
                        pp = True
                        l  =gh.Line(pts[i],pts[j])
                        cp = gh.CurveMiddle(l)
                        if gh.PointInCurve(cp,curve)[0]==2:
                            lscale = gh.Scale(l,cp,0.95)[0]
                            for k in temp:
                                if gh.CurveXCurve(lscale,k)[0]!=None:
                                    pp = False
                                    break
                            if pp==True:
                                temp.append(l)
                                break
        
        for i in range(len(pts)):
            if pd[i]!=2:
                for j in range(len(pts)):
                    if i!=j:
                        pp = True
                        l  =gh.Line(pts[i],pts[j])
                        cp = gh.CurveMiddle(l)
                        if gh.PointInCurve(cp,curve)[0]==2:
                            lscale = gh.Scale(l,cp,0.95)[0]
                            for k in temp:
                                if gh.CurveXCurve(lscale,k)[0]!=None:
                                    pp = False
                                    break
                            if pp==True:
                                d = gh.CurveClosestPoint(cp,com)[2]
                                k = gh.SortList(d,com)[1][0]
                                v1 = gh.Vector2Pt(gh.EndPoints(k)[0],gh.EndPoints(k)[1],False)[0]
                                v2 = gh.Vector2Pt(gh.EndPoints(l)[0],gh.EndPoints(l)[1],False)[0]
                                ang = gh.Angle(v1,v2)[0]
                                if ang<rat or ang>math.pi-rat:
                                    temp.append(l)
    a.append(temp)

a = ghtree.list_to_tree(a)
# ---------- end python_5 ----------
shift_4 = ShiftList(List=divide.Points, Shift=1, Wrap=False)
toggle_5 = BooleanToggle(False)  # disabled
cull_11 = CullPattern(List=duppt_4, CullPattern=larger_8.OrEqualTo)  # disabled
cull_12 = CullPattern(List=duppt_4, CullPattern=equals.Equality)  # disabled
flatten_3 = FlattenTree(Tree=ma.Result, Path="{0}")  # disabled
shift_5 = ShiftList(List=shift_4, Shift=-1, Wrap=False)  # -> simplify(List)
duppt_5 = RemoveDuplicatePts(Points=cull_11, Tolerance=3)  # disabled
subset_3 = SubList(List=duppt_5, Domain=Domain(0, 20), Wrap=True)  # -> List, Index; disabled
python_6 = GhPythonScript(pts=duppt_5, curves=pline, run=toggle_4)  # -> out, a; inputs pts: list of Point3d, curves: list of Curve, run: Boolean; disabled
# ---------- python_6: Python ----------
__author__ = "Platina"
__version__ = "2021.07.25"

import rhinoscriptsyntax as rs
import ghpythonlib.components as gh

def okpass(pt1,pt2):
    curve = rs.AddLine(pt1,pt2)
    l = rs.CurveLength(curve)
    pts = rs.DivideCurve(curve,4)[1:4]
    for j in range(len(a)):
        t = rs.CurveCurveIntersection(curve,a[j])
        if t!=None:
            if (rs.Distance(pt1,t[0][1])>0.01) or (rs.Distance(pt2,t[0][1])>0.01):
                return False
    for pt in pts:
        d = gh.CurveClosestPoint(pt,curves)[2]
        if min(d)<0.2*l:
            return True

def search(k):
    pt = pts[k]
    ptc,ptk,ptd = gh.ClosestPoints(pt,pts,10)
    for i in range(len(ptc)):
        if okpass(pt,ptc[i])==True:
            a.append(rs.AddLine(pt,ptc[i]))
            if pd[ptk[i]]==False:
                pd[ptk[i]] = True
                search(ptk[i])

if run:
    pd = [False for i in range(len(pts))]
    a = []
    
    for i in range(len(pts)):
        if pd[i]==False:
            pd[i] = True
            search(i)
# ---------- end python_6 ----------
python_7 = GhPythonScript(curves=subset_2.List, pts=cull_12, run=toggle_5)  # -> out, curves; inputs curves: list of Curve, pts: list of Point3d, run: Boolean; disabled; same code as python
path_mapper = PathMapper(shift_5, source="{a}", target="{0;a}")
flatten_4 = FlattenTree(Tree=python_5.a, Path="{0}")
del_2 = DelaunayMesh(Points=duppt_5, Plane=PlaneXY(0, 0, 0))  # disabled
dupln_6 = RemoveDuplicateLines(Lines=flatten_4, Tolerance=0.01)
dupln_7 = RemoveDuplicateLines(Lines=python_7.curves, Tolerance=0.01)  # disabled
mirror_2 = Mirror(Geometry=path_mapper, Plane=xz)  # -> Geometry, Transform
len_7 = Length(Curve=dupln_6)
python_8 = GhPythonScript(ptss=mirror_2.Geometry, pleaserun=bool_2)  # -> out, a; inputs ptss: tree of Point3d, pleaserun: Boolean
# ---------- python_8: Python ----------
import rhinoscriptsyntax as rs
import System.Drawing as SD
import ghpythonlib.components as gh
import ghpythonlib.treehelpers as ghtree

if pleaserun:
    
    ptss = ghtree.tree_to_list(ptss)
    
    filename = './/results//result_bou.jpg'
    
    img = SD.Bitmap(filename)
    
    a = []
    for pts in ptss:
        for pt in pts:
            x,y,z = gh.DeconstructVector(pt)
            pd = False
            for i in range(5):
                for j in range(5):
                    xx = int(x-2+i)
                    yy = int(y-2+j)
                    if xx>=0 and xx<=1023 and yy>=0 and yy<=1023:
                        color = img.GetPixel(int(xx), int(yy))
                        greyscale = 0.299*color.R + 0.587*color.G + 0.114*color.B
                        if greyscale<0.5:
                            pd = True
            if pd==True:
                break
        a.append(pd)
# ---------- end python_8 ----------
end_7 = EndPoints(Curve=dupln_7)  # -> Start, End; disabled
larger_9 = LargerThan(FirstNumber=len_7, SecondNumber=0.01)  # -> LargerThan, OrEqualTo
merge_5 = Merge(Data1=end_7.Start, Data2=end_7.End)  # disabled
cull_13 = CullPattern(List=dupln_6, CullPattern=larger_9.LargerThan)
duppt_6 = RemoveDuplicatePts(Points=merge_5, Tolerance=0.01)  # disabled
move_3 = Move(Geometry=cull_13, Motion=pt_4)  # -> Geometry, Transform
cull_14 = CullPattern(List=cluster_5, CullPattern=python_8.a)
cps_3 = ClosestPoints(Point=duppt_6, Cloud=merge_5, Count=3)  # -> ClosestPoint, CPIndex, Distance; disabled
scale_4 = Scale(Geometry=move_3.Geometry, Center=pt_4, Factor=division)  # -> Geometry, Transform
smaller_6 = SmallerThan(FirstNumber=cps_3.Distance, SecondNumber=0.01)  # -> SmallerThan, OrEqualTo; disabled
G = ClusterOutput(scale_4.Geometry)
crv_6 = Curve(cull_14)
ma_2 = MassAddition(Input=smaller_6.SmallerThan)  # -> Result, PartialResults; disabled
equals_2 = Equality(FirstNumber=ma_2.Result, SecondNumber=1)  # -> flatten(Equality), Inequality; disabled
cull_15 = CullPattern(List=duppt_6, CullPattern=equals_2.Equality)  # disabled
flatten_5 = FlattenTree(Tree=ma_2.Result, Path="{0}")  # disabled

grid_divisions_2 = Integer(20)
crv_7 = Curve(simplify(crv_6))
x_bounds_2 = Domain(Domain(1950, 3650))
y_bounds_2 = Domain(Domain(2750, 3550))

graft_5 = GraftTree(Tree=dupln_7, IncludeEmptyLists=True, IncludeNullItems=True)  # disabled
dom²_2 = Domain²(DomainU=x_bounds_2, DomainV=y_bounds_2)
crv_cp_2 = CurveClosestPoint(Point=cull_15, Curve=graft_5)  # -> Point, Parameter, Distance; disabled
smaller_7 = SmallerThan(FirstNumber=crv_cp_2.Distance, SecondNumber=0.01)  # -> SmallerThan, OrEqualTo; disabled
ma_3 = MassAddition(Input=smaller_7.SmallerThan)  # -> flatten(Result), PartialResults; disabled
hem_open_xy_networks_2 = VBScript(seg=crv_7, bnd=dom²_2, sbdv=grid_divisions_2)  # -> out, flatten(e), flatten(eOV), flatten(ePE), flatten(eNE), flatten(eTE), flatten(eIF), flatten(v)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; inputs seg: list of Curve; same code as hem_open_xy_networks
equals_3 = Equality(FirstNumber=ma_3.Result, SecondNumber=0)  # -> Equality, Inequality; disabled
pline_4 = PolyLine(Vertices=hem_open_xy_networks_2.f, Closed=True)
cull_16 = CullPattern(List=dupln_7, CullPattern=equals_3.Equality)  # disabled
flatten_6 = FlattenTree(Tree=pline_4, Path="{0}")
end_8 = EndPoints(Curve=cull_16)  # -> Start, End; disabled
srf_2 = Surface(flatten_6)
merge_6 = Merge(Data1=end_8.Start, Data2=end_8.End)  # disabled
area_2 = Area(Geometry=srf_2)  # -> Area, Centroid
duppt_7 = RemoveDuplicatePts(Points=merge_6, Tolerance=0.01)  # disabled
division_5 = Division(A=Slider(15, range=0..90), B=180)
sort_5 = SortList(Keys=area_2.Area, ValuesA=flatten_6)  # -> Keys, ValuesA
cps_4 = ClosestPoints(Point=duppt_7, Cloud=merge_6, Count=3)  # -> ClosestPoint, CPIndex, Distance; disabled
multiplication_4 = Multiplication(A=division_5, B=3.141592654)

# ---- group: make lines to polygons
shift_6 = ShiftList(List=sort_5.ValuesA, Shift=-1, Wrap=False)

# ----
smaller_8 = SmallerThan(FirstNumber=cps_4.Distance, SecondNumber=0.01)  # -> SmallerThan, OrEqualTo; disabled
python_9 = GhPythonScript(curves=shift_6, com=dupln_3, rat=multiplication_4)  # -> out, a; inputs curves: list of Curve, com: list of Curve; same code as python_5
graft_6 = GraftTree(Tree=shift_6, IncludeEmptyLists=True, IncludeNullItems=True)
ma_4 = MassAddition(Input=smaller_8.SmallerThan)  # -> Result, PartialResults; disabled
equals_4 = Equality(FirstNumber=ma_4.Result, SecondNumber=2)  # -> flatten(Equality), Inequality; disabled
toggle_6 = BooleanToggle(False)  # disabled
cull_17 = CullPattern(List=duppt_7, CullPattern=equals_4.Equality)  # disabled
flatten_7 = FlattenTree(Tree=ma_4.Result, Path="{0}")  # disabled
boundary = BoundarySurfaces(Edges=graft_6)  # -> flatten(Surfaces)
flatten_8 = FlattenTree(Tree=python_9.a, Path="{0}")
srf_3 = Surface(boundary)
python_10 = GhPythonScript(curves=cull_16, pts=cull_17, run=toggle_6)  # -> out, curves; inputs curves: list of Curve, pts: list of Point3d, run: Boolean; disabled; same code as python
dupln_8 = RemoveDuplicateLines(Lines=flatten_8, Tolerance=0.01)
dupln_9 = RemoveDuplicateLines(Lines=python_10.curves, Tolerance=0.01)  # disabled
len_8 = Length(Curve=dupln_8)
larger_10 = LargerThan(FirstNumber=len_8, SecondNumber=0.01)  # -> LargerThan, OrEqualTo
end_9 = EndPoints(Curve=dupln_9)  # -> Start, End; disabled
cull_18 = CullPattern(List=dupln_8, CullPattern=larger_10.LargerThan)
merge_7 = Merge(Data1=end_9.Start, Data2=end_9.End)  # disabled
move_4 = Move(Geometry=cull_18, Motion=pt_4)  # -> Geometry, Transform
duppt_8 = RemoveDuplicatePts(Points=merge_7, Tolerance=0.01)  # disabled
scale_5 = Scale(Geometry=move_4.Geometry, Center=pt_4, Factor=division)  # -> Geometry, Transform
cps_5 = ClosestPoints(Point=duppt_8, Cloud=merge_7, Count=3)  # -> ClosestPoint, CPIndex, Distance; disabled
G_2 = ClusterOutput(scale_5.Geometry)
smaller_9 = SmallerThan(FirstNumber=cps_5.Distance, SecondNumber=0.01)  # -> SmallerThan, OrEqualTo; disabled
ma_5 = MassAddition(Input=smaller_9.SmallerThan)  # -> Result, PartialResults; disabled
equals_5 = Equality(FirstNumber=ma_5.Result, SecondNumber=1)  # -> flatten(Equality), Inequality; disabled
cull_19 = CullPattern(List=duppt_8, CullPattern=equals_5.Equality)  # disabled
flatten_9 = FlattenTree(Tree=ma_5.Result, Path="{0}")  # disabled
graft_7 = GraftTree(Tree=dupln_9, IncludeEmptyLists=True, IncludeNullItems=True)  # disabled
crv_cp_3 = CurveClosestPoint(Point=cull_19, Curve=graft_7)  # -> Point, Parameter, Distance; disabled
smaller_10 = SmallerThan(FirstNumber=crv_cp_3.Distance, SecondNumber=0.01)  # -> SmallerThan, OrEqualTo; disabled
ma_6 = MassAddition(Input=smaller_10.SmallerThan)  # -> flatten(Result), PartialResults; disabled
equals_6 = Equality(FirstNumber=ma_6.Result, SecondNumber=0)  # -> Equality, Inequality; disabled
cull_20 = CullPattern(List=dupln_9, CullPattern=equals_6.Equality)  # disabled
end_10 = EndPoints(Curve=cull_20)  # -> Start, End; disabled
merge_8 = Merge(Data1=end_10.Start, Data2=end_10.End)  # disabled
duppt_9 = RemoveDuplicatePts(Points=merge_8, Tolerance=0.01)  # disabled
cps_6 = ClosestPoints(Point=duppt_9, Cloud=merge_8, Count=3)  # -> ClosestPoint, CPIndex, Distance; disabled
smaller_11 = SmallerThan(FirstNumber=cps_6.Distance, SecondNumber=0.01)  # -> SmallerThan, OrEqualTo; disabled
ma_7 = MassAddition(Input=smaller_11.SmallerThan)  # -> Result, PartialResults; disabled
equals_7 = Equality(FirstNumber=ma_7.Result, SecondNumber=2)  # -> flatten(Equality), Inequality; disabled
toggle_7 = BooleanToggle(False)  # disabled
cull_21 = CullPattern(List=duppt_9, CullPattern=equals_7.Equality)  # disabled
flatten_10 = FlattenTree(Tree=ma_7.Result, Path="{0}")  # disabled
python_11 = GhPythonScript(curves=cull_20, pts=cull_21, run=toggle_7)  # -> out, curves; inputs curves: list of Curve, pts: list of Point3d, run: Boolean; disabled; same code as python
dupln_10 = RemoveDuplicateLines(Lines=python_11.curves, Tolerance=0.01)  # disabled
end_11 = EndPoints(Curve=dupln_10)  # -> Start, End; disabled
merge_9 = Merge(Data1=end_11.Start, Data2=end_11.End)  # disabled
duppt_10 = RemoveDuplicatePts(Points=merge_9, Tolerance=0.01)  # disabled
cps_7 = ClosestPoints(Point=duppt_10, Cloud=merge_9, Count=3)  # -> ClosestPoint, CPIndex, Distance; disabled
smaller_12 = SmallerThan(FirstNumber=cps_7.Distance, SecondNumber=0.01)  # -> SmallerThan, OrEqualTo; disabled
ma_8 = MassAddition(Input=smaller_12.SmallerThan)  # -> Result, PartialResults; disabled
equals_8 = Equality(FirstNumber=ma_8.Result, SecondNumber=1)  # -> flatten(Equality), Inequality; disabled
cull_22 = CullPattern(List=duppt_10, CullPattern=equals_8.Equality)  # disabled
flatten_11 = FlattenTree(Tree=ma_8.Result, Path="{0}")  # disabled
graft_8 = GraftTree(Tree=dupln_10, IncludeEmptyLists=True, IncludeNullItems=True)  # disabled
crv_cp_4 = CurveClosestPoint(Point=cull_22, Curve=graft_8)  # -> Point, Parameter, Distance; disabled
smaller_13 = SmallerThan(FirstNumber=crv_cp_4.Distance, SecondNumber=0.01)  # -> SmallerThan, OrEqualTo; disabled
ma_9 = MassAddition(Input=smaller_13.SmallerThan)  # -> flatten(Result), PartialResults; disabled
equals_9 = Equality(FirstNumber=ma_9.Result, SecondNumber=0)  # -> Equality, Inequality; disabled
cull_23 = CullPattern(List=dupln_10, CullPattern=equals_9.Equality)  # disabled
end_12 = EndPoints(Curve=cull_23)  # -> Start, End; disabled
merge_10 = Merge(Data1=end_12.Start, Data2=end_12.End)  # disabled
duppt_11 = RemoveDuplicatePts(Points=merge_10, Tolerance=0.01)  # disabled
cps_8 = ClosestPoints(Point=duppt_11, Cloud=merge_10, Count=3)  # -> ClosestPoint, CPIndex, Distance; disabled
smaller_14 = SmallerThan(FirstNumber=cps_8.Distance, SecondNumber=0.01)  # -> SmallerThan, OrEqualTo; disabled
ma_10 = MassAddition(Input=smaller_14.SmallerThan)  # -> Result, PartialResults; disabled
equals_10 = Equality(FirstNumber=ma_10.Result, SecondNumber=2)  # -> flatten(Equality), Inequality; disabled
toggle_8 = BooleanToggle(False)  # disabled
cull_24 = CullPattern(List=duppt_11, CullPattern=equals_10.Equality)  # disabled
flatten_12 = FlattenTree(Tree=ma_10.Result, Path="{0}")  # disabled
python_12 = GhPythonScript(curves=cull_23, pts=cull_24, run=toggle_8)  # -> out, curves; inputs curves: list of Curve, pts: list of Point3d, run: Boolean; disabled; same code as python
dupln_11 = RemoveDuplicateLines(Lines=python_12.curves, Tolerance=0.01)  # disabled
end_13 = EndPoints(Curve=dupln_11)  # -> Start, End; disabled
merge_11 = Merge(Data1=end_13.Start, Data2=end_13.End)  # disabled
duppt_12 = RemoveDuplicatePts(Points=merge_11, Tolerance=0.01)  # disabled
cps_9 = ClosestPoints(Point=duppt_12, Cloud=merge_11, Count=3)  # -> ClosestPoint, CPIndex, Distance; disabled
smaller_15 = SmallerThan(FirstNumber=cps_9.Distance, SecondNumber=0.01)  # -> SmallerThan, OrEqualTo; disabled
ma_11 = MassAddition(Input=smaller_15.SmallerThan)  # -> Result, PartialResults; disabled
equals_11 = Equality(FirstNumber=ma_11.Result, SecondNumber=1)  # -> flatten(Equality), Inequality; disabled
cull_25 = CullPattern(List=duppt_12, CullPattern=equals_11.Equality)  # disabled
flatten_13 = FlattenTree(Tree=ma_11.Result, Path="{0}")  # disabled
graft_9 = GraftTree(Tree=dupln_11, IncludeEmptyLists=True, IncludeNullItems=True)  # disabled
crv_cp_5 = CurveClosestPoint(Point=cull_25, Curve=graft_9)  # -> Point, Parameter, Distance; disabled
smaller_16 = SmallerThan(FirstNumber=crv_cp_5.Distance, SecondNumber=0.01)  # -> SmallerThan, OrEqualTo; disabled
ma_12 = MassAddition(Input=smaller_16.SmallerThan)  # -> flatten(Result), PartialResults; disabled
equals_12 = Equality(FirstNumber=ma_12.Result, SecondNumber=0)  # -> Equality, Inequality; disabled
cull_26 = CullPattern(List=dupln_11, CullPattern=equals_12.Equality)  # disabled

# ==== cluster FaceConvex
srf = ClusterInput()
srf_2 = Surface(srf)
explode = Explode(Curve=srf_2, Recursive=True)  # -> Segments, simplify(Vertices)
shift = ShiftList(List=explode.Vertices, Shift=1, Wrap=False)
shift_2 = ShiftList(List=shift, Shift=1, Wrap=True)
shift_3 = ShiftList(List=shift, Shift=2, Wrap=True)
vec2pt = Vector2Pt(PointA=shift_2, PointB=shift_3, Unitize=False)  # -> Vector, Length
vec2pt_2 = Vector2Pt(PointA=shift, PointB=shift_2, Unitize=False)  # -> Vector, Length
angle = Angle(VectorA=vec2pt_2.Vector, VectorB=vec2pt.Vector)  # -> simplify(Angle), Reflex
xprod = CrossProduct(VectorA=vec2pt_2.Vector, VectorB=vec2pt.Vector, Unitize=False)  # -> Vector, Length
pdecon = Deconstruct(Point=xprod.Vector)  # -> XComponent, YComponent, simplify(ZComponent)
smaller = SmallerThan(FirstNumber=angle.Angle, SecondNumber="3/180*pi")  # -> SmallerThan, OrEqualTo
larger = LargerThan(FirstNumber=pdecon.ZComponent, SecondNumber=0)  # -> LargerThan, OrEqualTo
ma = MassAddition(Input=smaller.SmallerThan)  # -> Result, PartialResults
shift_4 = ShiftList(List=larger.LargerThan, Shift=1, Wrap=True)
equals = Equality(FirstNumber=ma.Result, SecondNumber=0)  # -> Equality, flatten(Inequality)
equals_2 = Equality(FirstNumber=larger.LargerThan, SecondNumber=shift_4)  # -> Equality, Inequality
not = GateNot(A=equals_2.Equality)
ma_2 = MassAddition(Input=not)  # -> flatten(Result), PartialResults
equals_3 = Equality(FirstNumber=ma_2.Result, SecondNumber=0)  # -> Equality, Inequality
not_2 = GateNot(A=equals_3.Equality)
or = GateOr(A=equals.Inequality, B=not_2)
sort = SortList(Keys=or)  # -> Keys, ValuesA
item = ListItem(List=sort.Keys, Index=0, Wrap=True)  # -> Item1, Item
gradient = Gradient(
    LowerLimit=item.Item,
    UpperLimit=item.Item1,
    Parameter=or,
    stops=[0: RGB(234, 38, 0), 0.25: RGB(234, 126, 0), 0.5: RGB(254, 244, 84), 0.75: RGB(173, 203, 249), 1: RGB(75, 107, 169)])
srf_3 = ClusterOutput(srf_2)
C = ClusterOutput(gradient)

# ==== cluster Generate_Optimization_Training_Data_Optional
txt = ClusterInput()
crv = ClusterInput()
crv_2 = ClusterInput()
txt_2 = Text(txt)
crv_3 = Curve(crv)
crv_4 = Curve(crv_2)
pleaserun = ClusterInput()
int = ClusterInput()
int_2 = Integer(int)
file = ReadFile(File=txt_2, PerLineParse=True)
num = Number(file)
lng = ListLength(List=num)
num_2 = Number(Slider(0.1, range=0..1))
division = Division(A=lng, B=2)
boundary = BoundarySurfaces(Edges=crv_3)
subtraction = Subtraction(A=division, B=1)
dom = ConstructDomain(DomainStart=0, DomainEnd=subtraction)
crv_5 = Curve(boundary)
subset = SubList(List=num, Domain=dom, Wrap=True)  # -> List, Index
explode = Explode(Curve=crv_5, Recursive=True)  # -> Segments, Vertices
pt = Point(explode.Vertices)
divide = DivideCurve(Curve=crv_4, Count=100, Kinks=False)  # -> Points, Tangents, Parameters
toggle = BooleanToggle(False)  # disabled
data = Data(subset.List)
python = GhPythonScript(pleaserun=pleaserun, constraint=divide.Points, marker=pt, ori=crv_3, ori_len=data, tor=num_2, num=int_2)  # -> out, bakeout, recs, recran, edgelengths, faceareas, file_path; inputs constraint: list of Point3d, marker: list of Point3d, ori: list of Curve, ori_len: list, num: Int32
# ---------- python: Python ----------
__author__ = "Hao"
__version__ = "2021.8.15"

import rhinoscriptsyntax as rs
import scriptcontext as sc
import Rhino
import ghpythonlib.treehelpers as ghtree
import math
import ghpythonlib.components as gh
import random

import clr
import os
import time
clr.AddReferenceToFileAndPath("C:\\PolyFramework\\PolyFramework.dll")

import Rhino.Geometry as rg
import PolyFramework as pf

if pleaserun :
    
    cir = gh.Interpolate(constraint,3,True)[0]
    
    edgelengths = []
    faceareas = []
    
    sc.doc = Rhino.RhinoDoc.ActiveDoc
    rhdoc = Rhino.RhinoDoc.ActiveDoc
    
    rs.Command("_SelLayerNumber "+str(rhdoc.Layers.FindName("_Form_InternalLines").Index))
    primal = pf.PFoam()
    dual = pf.PFoam()
    containerType = pf.ContainerType
    multiData = pf.LoadData.LoadPrimalDual(True)
    guids = multiData[0]
    primal = multiData[1]
    dual = multiData[2]
    containerType = multiData[3]
    geoouttemp = rs.ObjectsByLayer('_Form_ExternalForces')
    geoouttemp = [rs.coercecurve(j) for j in geoouttemp]
    ExternalForcestemp = geoouttemp
    pt1 = gh.EndPoints(ExternalForcestemp)[0]
    pt2 = gh.EndPoints(ExternalForcestemp)[1]
    pt1.extend(pt2)
    ptall = pt1
    result = []
    for i in range(len(ptall)):
        for j in range(len(marker)):
            if rs.Distance(ptall[i],marker[j])<0.01:
                result.append(ptall[i])
                break
    
    countq = [False for i in range(len(primal.Vertices))]
    count = -1
    for vert in primal.Vertices:
        count += 1
        id = vert.Id
        location = vert.Point
        for i in range(len(result)):
            if rs.Distance(result[i],location)<0.01:
                countq[count] = True
                break
    
    stpp = []
    enpp = []
    for i in range(len(ori)):
        temp = gh.EndPoints(ori[i])
        stpp.append(temp[0])
        enpp.append(temp[1])
    count = -1
    countm = [-1 for i in range(len(primal.Edges))]
    internalornot = [False for i in range(len(primal.Edges))]
    for edge in primal.Edges:
        count += 1
        for i in range(len(ori)):
            if (rs.Distance(stpp[i],edge.Vertices[0].Point)<0.01) and (rs.Distance(enpp[i],edge.Vertices[1].Point)<0.01) or (rs.Distance(stpp[i],edge.Vertices[1].Point)<0.01) and (rs.Distance(enpp[i],edge.Vertices[1].Point)<0.01):
                   countm[count] = i
                   internalornot[count] = True
                   break
    
    
    recs = []
    recran = []
    for i in range(num):
        
        ran = [random.random() for j in range(len(ori_len))]
        
        rs.Command("_SelLayerNumber "+str(rhdoc.Layers.FindName("_Form_InternalLines").Index))
        primal = pf.PFoam()
        dual = pf.PFoam()
        containerType = pf.ContainerType
        multiData = pf.LoadData.LoadPrimalDual(True)
        guids = multiData[0]
        primal = multiData[1]
        dual = multiData[2]
        containerType = multiData[3]
        
        pickedVertsup = []
        fixableVerts ={}
        count = -1
        for vert in primal.Vertices:
            count += 1
            id = vert.Id
            location = vert.Point
            if countq[count]==True:
                fixableVerts[location] = vert
                pickedVertsup.append(fixableVerts[location])
                primal.SetVertexConstraints([fixableVerts[location]], cir, 1.0, True)
        
        count = -1
        for edge in primal.Edges:
            count += 1
            if countm[count]!=-1:
               edge.MinLength = (0.5+ran[countm[count]]*1.0)*ori_len[countm[count]]*(1.0-tor)
               edge.MaxLength = (0.5+ran[countm[count]]*1.0)*ori_len[countm[count]]*(1.0+tor)
        
        primal.PerpSoft(maxSteps = 10000)
        #bakeout = pf.PFoam.SaveAsEdges(primal)
        
        edgelengthtemp = []
        faceareatemp = []
        rec = 9999999999999999
        count = -1
        for edge in primal.Edges:
            count += 1
            if (edge.Dual) and (edge.Id>=0):
                if (edge.GetLength()>0) and (edge.Dual.Area>0):
                    if internalornot[count]==True:
                        edgelength = edge.GetLength()
                        facearea = edge.Dual.Area/100
                        edgelengthtemp.append(edgelength)
                        faceareatemp.append(facearea)
                        bk = (facearea*facearea*facearea*facearea*math.pi/4*math.pi*math.pi*200)/(edgelength*edgelength)
                        if bk<rec:
                            print(edge.Id,edgelength,facearea,bk)
                            rec = bk
        recs.append(rec)
        recran.append(ran)
        edgelengths.append(edgelengthtemp)
        faceareas.append(faceareatemp)
        s = ""
        for i in range(len(ran)):
            s += str(ran[i])+","
        s += str(rec)
        with open("C:\AIStructureGenerator\ANN2\data.csv","a") as f:
            f.write(s)
            f.write("\n")
    
    file_path = "C:\AIStructureGenerator\ANN2\data.csv"
    recran = ghtree.list_to_tree(recran)
    edgelengths = ghtree.list_to_tree(edgelengths)
    faceareas = ghtree.list_to_tree(faceareas)
# ---------- end python ----------
python_2 = GhPythonScript(pleaserun=toggle, constraint=divide.Points, marker=pt, ori=crv_3, ori_len=data, tor=num_2, num=int_2)  # -> out, bakeout, recs, recran, edgelengths, faceareas, file_path, a; inputs constraint: list of Point3d, marker: list of Point3d, ori: list of Curve, ori_len: list, num: Int32; disabled
# ---------- python_2: Python ----------
__author__ = "Hao"
__version__ = "2021.8.15"

import rhinoscriptsyntax as rs
import scriptcontext as sc
import Rhino
import ghpythonlib.treehelpers as ghtree
import math
import ghpythonlib.components as gh
import random

import clr
import os
import time
clr.AddReferenceToFileAndPath("C:\\PolyFramework\\PolyFramework.dll")

import Rhino.Geometry as rg
import PolyFramework as pf

if pleaserun :
    
    cir = gh.Interpolate(constraint,3,True)[0]
    
    edgelengths = []
    faceareas = []
    
    sc.doc = Rhino.RhinoDoc.ActiveDoc
    rhdoc = Rhino.RhinoDoc.ActiveDoc
    
    rs.Command("_SelLayerNumber "+str(rhdoc.Layers.FindName("_Form_InternalLines").Index))
    primal = pf.PFoam()
    dual = pf.PFoam()
    containerType = pf.ContainerType
    multiData = pf.LoadData.LoadPrimalDual(True)
    guids = multiData[0]
    primal = multiData[1]
    dual = multiData[2]
    containerType = multiData[3]
    
    a = []
    for edge in primal.Edges:
        if (edge.Dual) and (edge.Id>=0):
            if edge.Id==1886:
                a.append(edge.CreateLine())
# ---------- end python_2 ----------
txt_3 = Text("C:\AIStructureGenerator\ANN2\data.csv")
crv_6 = Curve(python_2.a)  # disabled
txt_4 = ClusterOutput(txt_3)

# ==== cluster Cluster
curves = ClusterInput()
end = EndPoints(Curve=curves)  # -> Start, End
merge = Merge(Data1=end.Start, Data2=end.End)
duppt = RemoveDuplicatePts(Points=merge, Tolerance=0.01)
cps = ClosestPoints(Point=duppt, Cloud=merge, Count=3)  # -> ClosestPoint, CPIndex, Distance
smaller = SmallerThan(FirstNumber=cps.Distance, SecondNumber=0.01)  # -> SmallerThan, OrEqualTo
ma = MassAddition(Input=smaller.SmallerThan)  # -> Result, PartialResults
equals = Equality(FirstNumber=ma.Result, SecondNumber=2)  # -> flatten(Equality), Inequality
cull = CullPattern(List=duppt, CullPattern=equals.Equality)
flatten = FlattenTree(Tree=ma.Result, Path="{0}")
python = GhPythonScript(curves=curves, pts=cull, run=Toggle(True))  # -> out, curves; inputs curves: list of Curve, pts: list of Point3d, run: Boolean
# ---------- python: Python ----------
__author__ = "Platina"
__version__ = "2021.07.25"

import rhinoscriptsyntax as rs
import ghpythonlib.components as gh

if run:
    for i in range(len(pts)):
        d = gh.CurveClosestPoint(pts[i],curves)[2]
        t = []
        c = []
        curves_new = []
        for j in range(len(d)):
            if d[j]<0.01:
                t.append(j)
                c.append(curves[j])
            else:
                curves_new.append(curves[j])
        curves = curves_new
        c = gh.JoinCurves(c,False)
        curves.append(gh.Line(gh.EndPoints(c)[0],gh.EndPoints(c)[1]))
# ---------- end python ----------
dupln = RemoveDuplicateLines(Lines=python.curves, Tolerance=0.01)
end_2 = EndPoints(Curve=dupln)  # -> Start, End
merge_2 = Merge(Data1=end_2.Start, Data2=end_2.End)
duppt_2 = RemoveDuplicatePts(Points=merge_2, Tolerance=0.01)
cps_2 = ClosestPoints(Point=duppt_2, Cloud=merge_2, Count=3)  # -> ClosestPoint, CPIndex, Distance
smaller_2 = SmallerThan(FirstNumber=cps_2.Distance, SecondNumber=0.01)  # -> SmallerThan, OrEqualTo
ma_2 = MassAddition(Input=smaller_2.SmallerThan)  # -> Result, PartialResults
equals_2 = Equality(FirstNumber=ma_2.Result, SecondNumber=1)  # -> flatten(Equality), Inequality
cull_2 = CullPattern(List=duppt_2, CullPattern=equals_2.Equality)
flatten_2 = FlattenTree(Tree=ma_2.Result, Path="{0}")
graft = GraftTree(Tree=dupln, IncludeEmptyLists=True, IncludeNullItems=True)
crv_cp = CurveClosestPoint(Point=cull_2, Curve=graft)  # -> Point, Parameter, Distance
smaller_3 = SmallerThan(FirstNumber=crv_cp.Distance, SecondNumber=0.01)  # -> SmallerThan, OrEqualTo
ma_3 = MassAddition(Input=smaller_3.SmallerThan)  # -> flatten(Result), PartialResults
equals_3 = Equality(FirstNumber=ma_3.Result, SecondNumber=0)  # -> Equality, Inequality
nullrep = ReplaceNulls(Items=equals_3.Equality, Replacements=True)  # -> Items, Count
cull_3 = CullPattern(List=dupln, CullPattern=nullrep.Items)
L = ClusterOutput(cull_3)

# ==== cluster Remove1
C = ClusterInput()
end = EndPoints(Curve=C)  # -> Start, End
weave = Weave(Pattern=[0, 1], Stream0=end.Start, Stream1=end.End, NullGaps=False)
cps = ClosestPoints(Point=weave, Cloud=weave, Count=2)  # -> ClosestPoint, CPIndex, Distance
ma = MassAddition(Input=cps.Distance)  # -> flatten(Result), PartialResults
smaller = SmallerThan(FirstNumber=ma.Result, SecondNumber=0.01)  # -> SmallerThan, OrEqualTo
python = GhPythonScript(pd=smaller.SmallerThan, pts=weave)  # -> out, pts; inputs pd: list of Boolean, pts: list of Point3d
# ---------- python: Python ----------
__author__ = "Platina"
__version__ = "2021.08.09"

import rhinoscriptsyntax as rs

count = 1
while count!=0:
    count = 0
    for i in range(len(pd)):
        if pd[i]==False:
            count += 1
            pd[i] = True
            j = rs.PointCloudClosestPoints(pts,[pts[i]],10000)[0][1]
            pts[i] = pts[j]
# ---------- end python ----------
dispatch = Dispatch(List=python.pts, DispatchPattern=[True, False])  # -> ListA, ListB
ln = Line(StartPoint=dispatch.ListA, EndPoint=dispatch.ListB)
len = Length(Curve=ln)
larger = LargerThan(FirstNumber=len, SecondNumber=0.01)  # -> LargerThan, OrEqualTo
cull = CullPattern(List=ln, CullPattern=larger.LargerThan)
dupln = RemoveDuplicateLines(Lines=cull, Tolerance=0.01)
crv = Curve(dupln)
crv_2 = ClusterOutput(crv)

# ==== cluster Remove2
C = ClusterInput()
end = EndPoints(Curve=C)  # -> Start, End
weave = Weave(Pattern=[0, 1], Stream0=end.Start, Stream1=end.End, NullGaps=False)
cps = ClosestPoints(Point=weave, Cloud=weave, Count=3)  # -> ClosestPoint, CPIndex, Distance
item = ListItem(List=cps.Distance, Index=2, Wrap=True)  # -> flatten(Item)
smaller = SmallerThan(FirstNumber=item, SecondNumber=0.01)  # -> SmallerThan, OrEqualTo
python = GhPythonScript(pd=smaller.SmallerThan, pts=weave)  # -> out, pts, pd; inputs pd: list of Boolean, pts: list of Point3d
# ---------- python: Python ----------
__author__ = "Platina"
__version__ = "2021.08.09"

import rhinoscriptsyntax as rs

count = 1
while count!=0:
    count = 0
    for i in range(len(pd)):
        if pd[i]==False:
            count += 1
            pd[i] = True
            j = rs.PointCloudClosestPoints(pts,[pts[i]],10000)[0][2]
            pts[i] = pts[j]
# ---------- end python ----------
dispatch = Dispatch(List=python.pts, DispatchPattern=[True, False])  # -> ListA, ListB
ln = Line(StartPoint=dispatch.ListA, EndPoint=dispatch.ListB)
len = Length(Curve=ln)
larger = LargerThan(FirstNumber=len, SecondNumber=0.01)  # -> LargerThan, OrEqualTo
cull = CullPattern(List=ln, CullPattern=larger.LargerThan)
dupln = RemoveDuplicateLines(Lines=cull, Tolerance=0.01)
crv = Curve(dupln)
crv_2 = ClusterOutput(crv)
